# Grasshopper definition FCM Bridge_Final(v2.0.5).gh (Grasshopper 1.0.7)
# plug-ins: GrasshopperMidasLink, Bifocals

panel = Panel("/DB/TDNA")
panel_2 = Panel("""/DB/STAG
/DB/GRUP
/DB/LDGR
/DB/BNGR""")

# ----
# c-1. Section Outer Dimension
min_ho3 = Slider(2.1, range=0..10)
max_ho3 = Slider(6.4, range=0..10)

max_hi3 = Slider(5.325, range=0..10)
# c-2. Section Inner Dimension
min_hi3 = Slider(1.615, range=0..10)

send_request = SendRequest(COMMAND=panel, METHOD="DELETE")  # -> RESULT, ADDRESS
send_request_2 = SendRequest(COMMAND=panel_2, METHOD="DELETE")  # -> RESULT, ADDRESS
# Recalculating Button
trigger = Trigger(Interval=-1000, TimerInterval=1000, Target=line)
midas_setting = MidasSetting()  # -> APIURL, APIKey, Status

# ---- group: JI2 Dimension(J1 to J2)
distance_h2 = Slider(0, range=0..100)
distance_b2 = Slider(0, range=0..1)

# ---- group: JI3 Dimension(J1 to J3)
distance_b3 = Slider(0, range=0..0.2)

# ---- group: JI4 Dimension(J4 to J5)
distance_h4 = Slider(0, range=0..100)
distance_b4 = Slider(0, range=0..1)

# ---- group: JI5 Dimension
hi4_1 = Slider(0, range=0..100)

# ---- group: Inner H Dimension
hi5 = Slider(0.25, range=0..1)

# ----
# c. Section Size
# c-1. Section Outer Dimension
ho1 = Slider(0.25, range=0..1)
ho2 = Slider(0.35, range=0..1)
ho2_1 = Slider(0, range=0..100)
bo1 = Slider(2.8, range=0..10)
bo1_1 = Slider(1.05, range=0..10)
bo2 = Slider(0, range=0..100)
bo3 = Slider(3.55, range=0..10)

distance_h2_2 = Slider(0, range=0..100)
distance_b2_2 = Slider(0, range=0..1)
ho3_1 = Slider(0, range=0..100)
bo2_1 = Slider(0, range=0..1)

# ----
# c-2. Section Inner Dimension
hi1 = Slider(0.25, range=0..1)
hi2 = Slider(0.325, range=0..1)
hi2_1 = Slider(0, range=0..100)
number_slider = Slider(0.25, range=0..1)
number_slider_2 = Slider(0, range=0..100)

number_slider_3 = Slider(3.1, range=0..10)
number_slider_4 = Slider(1.35, range=0..10)
number_slider_5 = Slider(3.1, range=0..10)
number_slider_6 = Slider(1.85, range=0..10)

start_point = Slider(0, range=0..100)
# Parameter
end_point = Slider(300, range=0..500)
s1_m = Slider(2.1, range=0..5)
# c.Distance to End of Pier Table
s2_m = Slider(0.9, range=0..5)
# 3-1-C. FSM
# a. FSM Length
l1_m = Slider(16, range=0..100)
# b. FSM Divide Count
# Notice
# It is a section excluding the area from the starting point of FSM to Support.
count = Slider(4, range=0..10)
# c. Abutment Support Length
s3_m = Slider(2, range=0..5)
panel_3 = Panel(midas_setting.Status)

# ----
# 3-1-B. Pier Table
# a. Pier Point
p1_m = Slider(85, range=0..300)
# b. Pier Distance
p2_m = Slider(215, range=0..300)

# ----
# d. Abutment Divide Count
count_2 = Slider(2, range=0..10)
# 3-1-D. Key Segment
# a. Key Segment Length
l2_m = Slider(2, range=0..10)
# b. Divide Count
count_3 = Slider(10, range=0..10)
# 3-1-F. Pier
# a. Pier Length
l4_m = Slider(40, range=0..100)
# 3-1-E. Segment
# a. Segment Length
# b. Equal-interval Options
s5_m = Slider(3, range=0..10)
# Notice
# The Equal Interval option changes the Divide to the Length closest to the Divide Length.
boolean = BooleanToggle(False)
construct_point = ConstructPoint(XCoordinate=start_point, YCoordinate=start_point, ZCoordinate=start_point)
construct_point_2 = ConstructPoint(XCoordinate=end_point, YCoordinate=start_point, ZCoordinate=start_point)
# 3-1-A. Arrangement
line = Line(StartPoint=construct_point, EndPoint=construct_point_2)
curve = Curve(line)

# ----
# a. Material ID
# b. Material Name
power_of_10 = PowerOf10(Value=Slider(8, range=0..10))
multiplication = Multiplication(A=Slider(2, range=0..10), B=power_of_10)

curve_2 = Curve(<curve referenced from the Rhino model>)

# ---- group: Pier Table
length = Length(Curve=curve)
negative = Negative(Value=s2_m)
division = Division(A=p1_m, B=length)
division_2 = Division(A=p2_m, B=length)
negative_2 = Negative(Value=s1_m)
merge = Merge(Data1=s1_m, Data2=negative_2)
merge_2 = Merge(Data1=division, Data2=division_2)
curve_3 = Curve(curve)
multiplication_2 = Multiplication(A=length, B=merge_2)
subtraction = Subtraction(A=graft(multiplication_2), B=merge)
subtraction_2 = Subtraction(A=graft(subtraction), B=[s2_m, negative])
curve_4 = Curve(curve)
evaluate_length = EvaluateLength(Curve=curve_3, Length=multiplication_2, Normalized=False)  # -> Point, Tangent, Parameter
evaluate_length_2 = EvaluateLength(Curve=curve_3, Length=subtraction, Normalized=False)  # -> Point, Tangent, Parameter
evaluate_length_3 = EvaluateLength(Curve=curve_4, Length=subtraction_2, Normalized=False)  # -> Point, Tangent, Parameter
shift_paths = ShiftPaths(Data=evaluate_length_3.Point, Offset=-1)
# GEOMETRY
merge_3 = Merge(Data1=graft(evaluate_length.Point), Data2=evaluate_length_2.Point, Data3=shift_paths)
sort_points = SortPoints(Points=merge_3)  # -> Points, Indices
polyline = PolyLine(Vertices=sort_points.Points, Closed=False)
explode = Explode(Curve=polyline, Recursive=True)  # -> simplify(Segments), simplify(Vertices)
list_length = ListLength(List=explode.Segments)
partition_list = PartitionList(List=explode.Segments, Size=expr("x/2", list_length))
split_tree = SplitTree(Data=partition_list, Masks=flatten("{*;0}"))  # -> reverse(Positive), Negative
# 3-1 Modeling
merge_4 = Merge(Data1=split_tree.Positive, Data2=split_tree.Negative)
explode_2 = Explode(Curve=merge_4, Recursive=True)  # -> Segments, Vertices

# ----
curve_5 = Curve(curve)

# ----
# 3-2-A. Material Property
# 3-2-B. Time Dependent Material
# Material 1(C5000)
# Material 1(C5000)
# Material Link
# a. Material ID
# b. Material Name
# Material 2(C4000)
# Material 2(C4000)
# Material 3(Tendon)
# c. Modulus of Elasticity
# d. Thermal Coefficient
# Section
digit_scroller = DigitScroller(Scroller_Digits=12, Scroller_Prefix="Digit Scroller", Scroller_Radix=5, Scroller_Value=1e-05)
# a. Material ID
panel_4 = Panel("2")
# b. Material Name
panel_5 = Panel("Grade C4000")
# 3-2 Property
panel_6 = Panel("1")
concreate_material = ConcreateMaterial(MaterialID=panel_4, Name=panel_5, prevData_itemkey=2, prevData_key=0)
concreate_material_2 = ConcreateMaterial(MaterialID=panel_6, Name="Grade C5000", prevData_itemkey=1, prevData_key=0)
user_material = UserMaterial(
    MaterialID="3",
    Name="Tendon",
    ModulusOfElasticity=multiplication,
    ThermalCoefficient=digit_scroller,
    prevData_itemkey=3,
    prevData_key=0)
get_property = GetProperty(DATA=user_material)  # -> Command, ID, TYPE, NAME, PARAM
get_property_2 = GetProperty(DATA=concreate_material_2)  # -> Command, ID, TYPE, NAME, PARAM
get_property_3 = GetProperty(DATA=concreate_material)  # -> Command, ID, TYPE, NAME, PARAM
# Material
# a. Relative Humidity
# b. Concrete Age
number_slider_7 = Slider(70, range=0..100)
# c. Member Size
number_slider_8 = Slider(3, range=0..10)
# d. Compression Strength
number_slider_9 = Slider(1, range=0..10)
panel_7 = Panel("35000")  # "kN/m²"
# a. Relative Humidity
# b. Concrete Age
number_slider_10 = Slider(70, range=0..100)
# c. Member Size
number_slider_11 = Slider(3, range=0..10)
# d. Compression Strength
number_slider_12 = Slider(1, range=0..10)
panel_8 = Panel("28000")  # "kN/m²"
creep_shrinkage = CreepShrinkage(
    CreeShrinkageID=get_property_2.ID,
    MaterialName=get_property_2.NAME,
    CompressionStrength=panel_7,
    RelativeHumidity=number_slider_7,
    ConcreteAge=number_slider_8,
    MemberSize=number_slider_9,
    prevData_itemkey=1,
    prevData_key=0)
comp_strength = CompStrength(MaterialName=get_property_2.NAME, CompressionStrength=panel_7, prevData_itemkey=1, prevData_key=0)
creep_shrinkage_2 = CreepShrinkage(
    MaterialName=get_property_3.NAME,
    CompressionStrength=panel_8,
    RelativeHumidity=number_slider_10,
    ConcreteAge=number_slider_11,
    MemberSize=number_slider_12,
    prevData_itemkey=2,
    prevData_key=0)
comp_strength_2 = CompStrength(MaterialName=get_property_3.NAME, CompressionStrength=panel_8, prevData_itemkey=3, prevData_key=0)
get_property_4 = GetProperty(DATA=creep_shrinkage)  # -> Command, ID, NAME, CODE, STR, HU, AGE, MSIZE, CTYPE
get_property_5 = GetProperty(DATA=comp_strength)  # -> Command, ID, NAME, TYPE, CODENAME, STRENGTH, ICTYPE, NAGGRE
get_property_6 = GetProperty(DATA=creep_shrinkage_2)  # -> Command, ID, NAME, CODE, STR, HU, AGE, MSIZE, CTYPE
get_property_7 = GetProperty(DATA=comp_strength_2)  # -> Command, ID, NAME, TYPE, CODENAME, STRENGTH, ICTYPE, NAGGRE
time_dependent_material_link = TimeDependentMaterialLink(
    MaterialNo=get_property_2.ID,
    CreepShrinkageName=get_property_4.NAME,
    CompStrengthName=get_property_5.NAME,
    prevData_itemkey=1,
    prevData_key=0)
time_dependent_material_link_2 = TimeDependentMaterialLink(
    MaterialNo=get_property_3.ID,
    CreepShrinkageName=get_property_6.NAME,
    CompStrengthName=get_property_7.NAME,
    prevData_itemkey=2,
    prevData_key=0)

# ---- group: KegSegment
division_3 = Division(A=l2_m, B=2)
addition = Addition(A=p1_m, B=p2_m)
addition_2 = Addition(A=l1_m, B=division_3)
division_4 = Division(A=addition, B=2)
division_5 = Division(A=l2_m, B=2)
subtraction_3 = Subtraction(A=length, B=addition_2)
merge_5 = Merge(Data1=addition_2, Data2=division_4, Data3=subtraction_3)  # -> graft(Result)
addition_3 = Addition(A=merge_5, B=division_5)
subtraction_4 = Subtraction(A=merge_5, B=division_5)
merge_6 = Merge(Data1=addition_2, Data2=division_4, Data3=subtraction_3)
merge_7 = Merge(Data1=subtraction_4, Data2=addition_3)
evaluate_length_4 = EvaluateLength(Curve=curve_4, Length=merge_6, Normalized=False)  # -> Point, Tangent, Parameter
evaluate_length_5 = EvaluateLength(Curve=curve_4, Length=merge_7, Normalized=False)  # -> Point, Tangent, Parameter
merge_8 = Merge(Data1=graft(evaluate_length_4.Point), Data2=evaluate_length_5.Point)
sort_points_2 = SortPoints(Points=merge_8)  # -> Points, Indices
polyline_2 = PolyLine(Vertices=sort_points_2.Points, Closed=False)
explode_3 = Explode(Curve=polyline_2, Recursive=True)  # -> simplify(Segments), simplify(Vertices)

# ---- group: FSM
explode_tree = ExplodeTree(Data=merge_7)  # -> Branch0, Branch1, Branch2
list_item = ListItem(List=explode_tree.Branch0, Index=0, Wrap=True)
list_item_2 = ListItem(List=explode_tree.Branch2, Index=1, Wrap=True)
curve_6 = Curve(curve)
subtraction_5 = Subtraction(A=length, B=s3_m)
evaluate_length_6 = EvaluateLength(Curve=curve_6, Length=list_item, Normalized=False)  # -> Point, Tangent, Parameter
evaluate_length_7 = EvaluateLength(Curve=curve_6, Length=list_item_2, Normalized=False)  # -> Point, Tangent, Parameter
evaluate_length_8 = EvaluateLength(Curve=curve_6, Length=s3_m, Normalized=False)  # -> Point, Tangent, Parameter
evaluate_length_9 = EvaluateLength(Curve=curve_6, Length=subtraction_5, Normalized=False)  # -> Point, Tangent, Parameter
evaluate_length_10 = EvaluateLength(Curve=curve_6, Length=curve, Normalized=False)  # -> Point, Tangent, Parameter
construct_domain = ConstructDomain(DomainStart=evaluate_length_8.Parameter, DomainEnd=evaluate_length_6.Parameter)
construct_domain_2 = ConstructDomain(DomainStart=evaluate_length_7.Parameter, DomainEnd=evaluate_length_9.Parameter)
tree_statistics = TreeStatistics(Tree=construct_domain_2)  # -> Paths, Length, Count
construct_domain_3 = ConstructDomain(DomainStart=0, DomainEnd=evaluate_length_8.Parameter)
construct_domain_4 = ConstructDomain(DomainStart=evaluate_length_9.Parameter, DomainEnd=evaluate_length_10.Parameter)
replace_paths = ReplacePaths(Data=construct_domain_2, Search=tree_statistics.Paths, Replace="{0;1}")
sub_curve = SubCurve(BaseCurve=curve_6, Domain=[construct_domain_3, construct_domain_4])
sub_curve_2 = SubCurve(BaseCurve=curve_6, Domain=[construct_domain, replace_paths])
divide_curve = DivideCurve(Curve=sub_curve_2, Count=count, Kinks=False)  # -> Points, Tangents, Parameters
divide_curve_2 = DivideCurve(Curve=sub_curve, Count=count_2, Kinks=False)  # -> Points, Tangents, Parameters
sort_points_3 = SortPoints(Points=divide_curve_2.Points)  # -> Points, Indices
sort_points_4 = SortPoints(Points=divide_curve.Points)  # -> Points, Indices
polyline_3 = PolyLine(Vertices=sort_points_3.Points, Closed=False)
polyline_4 = PolyLine(Vertices=divide_curve.Points, Closed=False)
explode_4 = Explode(Curve=polyline_4, Recursive=True)  # -> simplify(Segments), simplify(Vertices)
explode_5 = Explode(Curve=polyline_3, Recursive=True)  # -> simplify(Segments), simplify(Vertices)
merge_9 = Merge(Data1=explode_5.Segments, Data2=explode_4.Segments)
merge_10 = Merge(Data1=explode_5.Vertices, Data2=explode_4.Vertices)

# ----
curve_7 = Curve(curve_5)

# ---- group: Pier
addition_4 = Addition(A=ho1, B=ho2, C=ho2_1, D=max_ho3)
unit_z = UnitZ(Factor=expr("-x", addition_4))
unit_z_2 = UnitZ(Factor=expr("-x", l4_m))
move = Move(Geometry=evaluate_length_2.Point, Motion=unit_z)  # -> Geometry, Transform
move_2 = Move(Geometry=move.Geometry, Motion=unit_z_2)  # -> Geometry, Transform
line_2 = Line(StartPoint=move_2.Geometry, EndPoint=move.Geometry)
divide_curve_3 = DivideCurve(Curve=line_2, Count=count_3, Kinks=False)  # -> Points, Tangents, Parameters
polyline_5 = PolyLine(Vertices=divide_curve_3.Points, Closed=False)
explode_6 = Explode(Curve=polyline_5, Recursive=True)  # -> Segments, Vertices
shift_paths_2 = ShiftPaths(Data=explode_6.Segments, Offset=-1)

# ----
number_slider_13 = Slider(8.1, range=0..10)
# a. Section ID
# b. Section Name
# c. Section Size
number_slider_14 = Slider(1.8, range=0..10)

# ---- group: Rotation Angle
data = Data(evaluate_length_2.Tangent)
unit_x = UnitX(Factor=1)
deconstruct_vector = DeconstructVector(Vector=data)  # -> XComponent, YComponent, ZComponent
ghpython_script = GhPythonScript(x=deconstruct_vector.YComponent, y=data)  # -> out, a; same code as ghpython_script
angle = Angle(VectorA=unit_x, VectorB=ghpython_script.a)  # -> Angle, Reflex
degrees = Degrees(Radians=angle.Angle)  # -> graft(Degrees)

# ---- group: Pier
rectangle = Rectangle(Plane=PlaneXY(0, 0, 0), XSize=number_slider_14, YSize=number_slider_13, Radius=0)  # -> Rectangle, Length
polygon_center = PolygonCenter(Polyline=rectangle.Rectangle)  # -> CenterV, CenterE, CenterA
move_3 = Move(Geometry=rectangle.Rectangle, Motion=expr("-x", polygon_center.CenterA))  # -> Geometry, Transform
vec2pt = Vector2Pt(PointA=Point(0, 0, 0), PointB=explode_6.Vertices, Unitize=False)  # -> Vector, Length
move_4 = Move(Geometry=move_3.Geometry, Motion=vec2pt.Vector)  # -> Geometry, Transform
xy_plane = XYPlane(Origin=vec2pt.Vector)
number = Number(graft(angle.Angle))
rotate = Rotate(Geometry=move_4.Geometry, Angle=number, Plane=xy_plane)  # -> Geometry, Transform
loft = Loft(Curves=rotate.Geometry, Options={Adjust=False, Closed=False, LoftEnds=0, LoftSimp=0, LoftType=0, Rebuild=10, Refit=0.01})

# ----
# Parameter
# 3-4-A. Static Load Case
# a. Name
panel_9 = Panel("""Self
2nd
TimeLoad
PS
FT
WC""")
# 3-4-B. Self Weight
# a. Self Weight Factor
# 3-4-C. 2nd Load
factor = Slider(-1, range=-2..0)
# a. Load Value
# 3-4-D. Form Travelling Load
w_kn_m = Slider(35, range=0..100)
# a. Load Value
# b. Form Traveller Position
p_kn = Slider(800, range=0..1000)
e_m = Slider(2.5, range=0..10)

# ----
# c. Wire
area_m² = ValueList({"12.7mm(0.5\")": 9.871e-05, "15.2mm(0.6\")": 0.0001387}, selected="15.2mm(0.6\")")
count_ea = Slider(19, range=0..100)
fpu_n_mm² = ValueList({"12.7mm(0.5\")": 1850, "15.2mm(0.6\")": 1850}, selected="15.2mm(0.6\")")
fpy_n_mm² = ValueList({"12.7mm(0.5\")": 1600, "15.2mm(0.6\")": 1600}, selected="15.2mm(0.6\")")

# ----
# e. Friction Factor
curvature = Slider(0.2, range=0..1)
# f. Anchorage Slip
wobble = Slider(0.001, range=0..0.001)

# ----
# b. Import File
# c .Tendon Name
geometry_pipeline = GeometryPipeline(
    GroupByLayer=False,
    GroupByType=False,
    IncludeHidden=True,
    IncludeLocked=True,
    LayerFilter="Pier1_Top",
    NameFilter="*",
    SublayerFiltering=True,
    TypeFilter=4)

# ----
# b. Import File
# c. Tendon Name
geometry_pipeline_2 = GeometryPipeline(
    GroupByLayer=False,
    GroupByType=False,
    IncludeHidden=True,
    IncludeLocked=True,
    LayerFilter="Pier2_Top",
    NameFilter="*",
    SublayerFiltering=True,
    TypeFilter=4)

# ----
# b. Import File
# c. Tendon Name
geometry_pipeline_3 = GeometryPipeline(
    GroupByLayer=False,
    GroupByType=False,
    IncludeHidden=True,
    IncludeLocked=True,
    LayerFilter="Left_Bot",
    NameFilter="*",
    SublayerFiltering=True,
    TypeFilter=4)

# ----
# b. Import File
# c. Tendon Name
geometry_pipeline_4 = GeometryPipeline(
    GroupByLayer=False,
    GroupByType=False,
    IncludeHidden=True,
    IncludeLocked=True,
    LayerFilter="Cent_Bot",
    NameFilter="*",
    SublayerFiltering=True,
    TypeFilter=4)

# ----
# b. Import File
# c. Tendon Name
geometry_pipeline_5 = GeometryPipeline(
    GroupByLayer=False,
    GroupByType=False,
    IncludeHidden=True,
    IncludeLocked=True,
    LayerFilter="Right_Bot",
    NameFilter="*",
    SublayerFiltering=True,
    TypeFilter=4)

# ----
# d. Duct
diameter_m = Slider(0.1, range=0..0.1)
length_m = Slider(0.006, range=0..0.01)
# Parameter
# 3-5-A. Tendon Porperty
# b.Tendon Name
panel_10 = Panel("""Top
Bottom""")

# ----
# 3-5-B. Tendon Profile
# a. Reference Line Position
panel_11 = Panel("{0,-100,0}")

# ---- group: Reference Line
line_3 = Line(StartPoint=panel_11, EndPoint="{300,-100,0}")

# ----
length_2 = Length(Curve=line_3)
number_slider_15 = Slider(0, range=0..100)
number_slider_16 = Slider(0, range=0..100)
number_slider_17 = Slider(0, range=0..100)
number_slider_18 = Slider(0, range=0..100)
number_slider_19 = Slider(0, range=0..100)

# ----
# 3-6-B. Duration
# a. Stage Date
pier_date = Slider(100, range=0..200)
piertable_date = Slider(15, range=0..200)
fsm_date = Slider(60, range=0..200)
_1_segment_date = Slider(5, range=0..10)
key_segment_date = Slider(10, range=0..20)

# ----
# b. Additional Date(Working Date)
_1_segment_date_2 = Slider(7, range=0..10)
key_segment_date_2 = Slider(20, range=0..30)

# ----
# c. Connection Date
working_date = Slider(0, range=0..20)
# d. Permanent Date
date = Slider(10000, range=0..10000)
# b. After Segment Consturction Step
after_segment_consturction_step = Panel("5")
addition_5 = Addition(A=key_segment_date, B=key_segment_date_2)
addition_6 = Addition(A=_1_segment_date, B=_1_segment_date_2)
# b. Grouting Stage
stage = Slider(1, range=0..1)
stage_2 = Slider(1, range=0..1)
value_kn_m² = Slider(13330000, range=0..100000000)
value_kn_m²_2 = Slider(0, range=0..100000000)
stage_3 = Slider(1, range=0..1)
value_kn_m²_3 = Slider(13330000, range=0..100000000)
value_kn_m²_4 = Slider(0, range=0..100000000)
stage_4 = Slider(1, range=0..1)
value_kn_m²_5 = Slider(13330000, range=0..100000000)
value_kn_m²_6 = Slider(0, range=0..100000000)
value_kn_m²_7 = Slider(13330000, range=0..100000000)
stage_5 = Slider(1, range=0..1)
stage_6 = Slider(1, range=0..1)
stage_7 = Slider(1, range=0..1)
value_kn_m²_8 = Slider(13330000, range=0..100000000)

# ----
# a. Tendon Jaking Force
value_kn_m²_9 = Panel("""13330000
0
13330000
0""")
value_kn_m²_10 = Panel("""0
13330000
0
13330000""")

value_kn_m²_11 = Panel("""13330000
0
13330000
0""")
value_kn_m²_12 = Panel("""0
13330000
0
13330000""")

# ----
# A. Geometry
# B. Define Property
# C. Data Matching
# D. Boundary & C.S Stage
# E. Define Load
# F. Tendon Data Delete
# G. Assign Load & Tendon
trigger_2 = Trigger(Interval=-1000, TimerInterval=1000, Target=[concatenate_6, panel, get_object])
trigger_3 = Trigger(Interval=-1000, TimerInterval=1000, Target=[data_16, data_17, panel_2])

# ----
# 3-2-C. Section Property
# Section 1(Pier)
# Section Dimension
# Section 2(Segment)
# Change Offset Option
# Section 3(FSM)
# Section 4(PierTable)
hi3_1 = Slider(0, range=0..1)
web_thick_for_shear_of_psc_shape = WebThickForShearOfPSCShape(prevData_itemkey=0, prevData_key=0)
shear_check_of_psc_shape = ShearCheckOfPSCShape(prevData_itemkey=0, prevData_key=0)
additional_option = AdditionalOption(prevData_itemkey=0, prevData_key=0)
change_offset = ChangeOffset(OffsetDirection="CT", prevData_itemkey=0, prevData_key=0)
# a. Section ID
# b. Section Name
number_slider_20 = Slider(2, range=0..10)
# a. Section ID
# b. Section Name
number_slider_21 = Slider(3, range=0..10)
# d. Section Shape
shape_user = ShapeUser(H=number_slider_14, B=number_slider_13, prevData_itemkey=0, prevData_key=0)
section = Section(SectionID="1", SectionName="Pier", Shape=shape_user, prevData_itemkey=1, prevData_key=0)
get_property_8 = GetProperty(DATA=section)  # -> Command, ID, SECT_NAME, SECTTYPE, SECT_BEFORE

# ---- group: Segment
explode_tree_2 = ExplodeTree(Data=subtraction_2)  # -> Branch0, Branch1, Branch2, Branch3
explode_tree_3 = ExplodeTree(Data=merge_7)  # -> Branch0, Branch1, Branch2
list_item_3 = ListItem(List=explode_tree_2.Branch0, Index=0, Wrap=True)
list_item_4 = ListItem(List=explode_tree_2.Branch2, Index=0, Wrap=True)
list_item_5 = ListItem(List=explode_tree_2.Branch3, Index=1, Wrap=True)
list_item_6 = ListItem(List=explode_tree_3.Branch0, Index=1, Wrap=True)
list_item_7 = ListItem(List=explode_tree_3.Branch1, Index=0, Wrap=True)
list_item_8 = ListItem(List=explode_tree_3.Branch1, Index=1, Wrap=True)
list_item_9 = ListItem(List=explode_tree_3.Branch2, Index=0, Wrap=True)
list_item_10 = ListItem(List=explode_tree_2.Branch1, Index=1, Wrap=True)
evaluate_length_11 = EvaluateLength(Curve=curve_5, Length=list_item_3, Normalized=False)  # -> Point, Tangent, Parameter
evaluate_length_12 = EvaluateLength(Curve=curve_5, Length=list_item_10, Normalized=False)  # -> Point, Tangent, Parameter
evaluate_length_13 = EvaluateLength(Curve=curve_5, Length=list_item_4, Normalized=False)  # -> Point, Tangent, Parameter
evaluate_length_14 = EvaluateLength(Curve=curve_5, Length=list_item_5, Normalized=False)  # -> Point, Tangent, Parameter
evaluate_length_15 = EvaluateLength(Curve=curve_5, Length=list_item_6, Normalized=False)  # -> Point, Tangent, Parameter
evaluate_length_16 = EvaluateLength(Curve=curve_5, Length=list_item_7, Normalized=False)  # -> Point, Tangent, Parameter
evaluate_length_17 = EvaluateLength(Curve=curve_5, Length=list_item_8, Normalized=False)  # -> Point, Tangent, Parameter
evaluate_length_18 = EvaluateLength(Curve=curve_5, Length=list_item_9, Normalized=False)  # -> Point, Tangent, Parameter
construct_domain_5 = ConstructDomain(DomainStart=evaluate_length_14.Parameter, DomainEnd=evaluate_length_18.Parameter)
construct_domain_6 = ConstructDomain(DomainStart=evaluate_length_15.Parameter, DomainEnd=evaluate_length_11.Parameter)
construct_domain_7 = ConstructDomain(DomainStart=evaluate_length_12.Parameter, DomainEnd=evaluate_length_16.Parameter)
construct_domain_8 = ConstructDomain(DomainStart=evaluate_length_17.Parameter, DomainEnd=evaluate_length_13.Parameter)
sub_curve_3 = SubCurve(BaseCurve=curve_7, Domain=construct_domain_6)
sub_curve_4 = SubCurve(BaseCurve=curve_7, Domain=construct_domain_7)
sub_curve_5 = SubCurve(BaseCurve=curve_7, Domain=construct_domain_8)
sub_curve_6 = SubCurve(BaseCurve=curve_7, Domain=construct_domain_5)
length_3 = Length(Curve=sub_curve_5)
length_4 = Length(Curve=sub_curve_6)
length_5 = Length(Curve=sub_curve_4)
length_6 = Length(Curve=sub_curve_3)
data_2 = Data(s5_m)
data_3 = Data(boolean)
data_4 = Data(s5_m)
data_5 = Data(boolean)
data_6 = Data(s5_m)
data_7 = Data(boolean)
data_8 = Data(boolean)
data_9 = Data(s5_m)
ghpython_script_2 = GhPythonScript(x=data_9, y=length_6, z=data_8)  # -> out, a
# ---------- ghpython_script_2: Python ----------
__author__ = "kjw0601"
__version__ = "2024.11.11"

import rhinoscriptsyntax as rs

if z == False :
    a = x
else :
    a = y/round(y/x,0)
# ---------- end ghpython_script_2 ----------
ghpython_script_3 = GhPythonScript(x=data_6, y=length_5, z=data_7)  # -> out, a; same code as ghpython_script_2
ghpython_script_4 = GhPythonScript(x=data_2, y=length_3, z=data_3)  # -> out, a; same code as ghpython_script_2
ghpython_script_5 = GhPythonScript(x=data_4, y=length_4, z=data_5)  # -> out, a; same code as ghpython_script_2
end_points = EndPoints(Curve=sub_curve_4)  # -> Start, graft(End)
divide_length = DivideLength(Curve=sub_curve_4, Length=ghpython_script_3.a)  # -> Points, Tangents, Parameters
divide_length_2 = DivideLength(Curve=sub_curve_6, Length=ghpython_script_5.a)  # -> Points, Tangents, Parameters
end_points_2 = EndPoints(Curve=sub_curve_6)  # -> Start, graft(End)
merge_11 = Merge(Data1=divide_length_2.Points, Data2=end_points_2.End)
merge_12 = Merge(Data1=divide_length.Points, Data2=end_points.End)
cull_duplicates = CullDuplicates(Points=merge_12, Tolerance=0.1, CullMode=3)  # -> Points, Indices, Valence
cull_duplicates_2 = CullDuplicates(Points=merge_11, Tolerance=0.1, CullMode=3)  # -> Points, Indices, Valence

# ----
flip_curve = FlipCurve(Curve=sub_curve_3)  # -> Curve, Flag
flip_curve_2 = FlipCurve(Curve=sub_curve_5)  # -> Curve, Flag
shift_paths_3 = ShiftPaths(Data=cull_duplicates.Points, Offset=-1)
shift_paths_4 = ShiftPaths(Data=cull_duplicates_2.Points, Offset=-1)

# ---- group: Segment (continued)
divide_length_3 = DivideLength(Curve=flip_curve.Curve, Length=ghpython_script_2.a)  # -> Points, Tangents, expr("-x", Parameters)
divide_length_4 = DivideLength(Curve=flip_curve_2.Curve, Length=ghpython_script_4.a)  # -> Points, Tangents, Parameters
end_points_3 = EndPoints(Curve=flip_curve.Curve)  # -> Start, graft(End)
end_points_4 = EndPoints(Curve=flip_curve_2.Curve)  # -> Start, graft(End)
merge_13 = Merge(Data1=divide_length_3.Points, Data2=end_points_3.End)
merge_14 = Merge(Data1=divide_length_4.Points, Data2=end_points_4.End)
cull_duplicates_3 = CullDuplicates(Points=merge_13, Tolerance=0.1, CullMode=3)  # -> Points, Indices, Valence
cull_duplicates_4 = CullDuplicates(Points=merge_14, Tolerance=0.1, CullMode=3)  # -> Points, Indices, Valence
sort_points_5 = SortPoints(Points=shift_paths_3)  # -> Points, Indices
sort_points_6 = SortPoints(Points=shift_paths_4)  # -> Points, Indices
polyline_6 = PolyLine(Vertices=sort_points_5.Points, Closed=False)
polyline_7 = PolyLine(Vertices=sort_points_6.Points, Closed=False)
explode_7 = Explode(Curve=polyline_6, Recursive=True)  # -> Segments, Vertices
explode_8 = Explode(Curve=polyline_7, Recursive=True)  # -> Segments, Vertices

# ---- group: Member Count
entwine = Entwine(
    Branch00=cull_duplicates_3.Points,
    Branch01=cull_duplicates.Points,
    Branch02=cull_duplicates_4.Points,
    Branch03=cull_duplicates_2.Points,
    FlattenInputs=True)
list_length_2 = ListLength(List=entwine)
subtraction_6 = Subtraction(A=list_length_2, B=1)
panel_12 = Panel(subtraction_6)

# ---- group: Height of element section
evaluate = Evaluate(Expression="-(y-z)/x²", x=panel_12, y=max_ho3, z=min_ho3)
series = Series(Start=0, Step=1, Count=expr("x+1", panel_12))
evaluate_2 = Evaluate(Expression="-(a*x^2-C)", a=evaluate, x=series, C=min_ho3)

evaluate_3 = Evaluate(Expression="-(y-z)/x²", x=panel_12, y=max_hi3, z=min_hi3)
series_2 = Series(Start=0, Step=1, Count=expr("x+1", panel_12))
evaluate_4 = Evaluate(Expression="-(a*x^2-C)", a=evaluate_3, x=series_2, C=min_hi3)

# ----
bi1_1 = BI11(
    X=number_slider_4,
    Y=hi2_1,
    X_2=distance_b2,
    Y_2=distance_h2,
    X_3=number_slider_3,
    X_4=distance_b3,
    Y_3=hi3_1,
    X_8=distance_b4,
    Y_5=distance_h4,
    X_7=number_slider_6,
    num=hi1,
    Y_4=number_slider_2,
    X_5=number_slider_5,
    num_2=hi2,
    num_3=reverse(simplify(graft(evaluate_4))),
    X_6=number_slider_5,
    num_4=number_slider,
    num_5=hi5)
cluster = Cluster_7(
    F=ho1,
    num=bo1,
    X=bo1_1,
    num_2=bo2,
    Y=ho2_1,
    num_3=bo3,
    X_2=distance_h2_2,
    Y_3=distance_b2_2,
    Y_4=ho2,
    X_3=bo2_1,
    Y_5=ho3_1,
    Y_6=reverse(simplify(graft(evaluate_2))))
shift_paths_5 = ShiftPaths(Data=cull_duplicates_3.Points, Offset=-1)
shift_paths_6 = ShiftPaths(Data=cull_duplicates_4.Points, Offset=-1)

# ---- group: Segment (continued)
sort_points_7 = SortPoints(Points=shift_paths_6)  # -> Points, Indices
sort_points_8 = SortPoints(Points=shift_paths_5)  # -> Points, Indices
polyline_8 = PolyLine(Vertices=sort_points_8.Points, Closed=False)
polyline_9 = PolyLine(Vertices=sort_points_7.Points, Closed=False)
explode_9 = Explode(Curve=polyline_8, Recursive=True)  # -> reverse(Segments), reverse(Vertices)
explode_10 = Explode(Curve=polyline_9, Recursive=True)  # -> reverse(Segments), reverse(Vertices)
entwine_2 = Entwine(
    Branch00=explode_9.Segments,
    Branch01=explode_7.Segments,
    Branch02=explode_10.Segments,
    Branch03=explode_8.Segments,
    FlattenInputs=True)
entwine_3 = Entwine(
    Branch00=explode_9.Vertices,
    Branch01=explode_7.Vertices,
    Branch02=explode_10.Vertices,
    Branch03=explode_8.Vertices,
    FlattenInputs=True)

cullpt = CullDuplicates(Points=cluster, Tolerance=0.001, CullMode=3)  # -> Points, Indices, Valence
cullpt_2 = CullDuplicates(Points=bi1_1, Tolerance=0.1, CullMode=3)  # -> Points, Indices, Valence
shift_paths_7 = ShiftPaths(Data=cullpt_2.Points, Offset=expr("-1", -2))
pline = PolyLine(Vertices=cullpt.Points, Closed=True)
pline_2 = PolyLine(Vertices=cullpt_2.Points, Closed=True)
shift_paths_8 = ShiftPaths(Data=pline, Offset=-2)
split_tree_2 = SplitTree(Data=shift_paths_7, Masks=flatten("{*;0}"))  # -> Positive, Negative
shift_paths_9 = ShiftPaths(Data=pline_2, Offset=-2)
# Modeling Shape
explode_tree_4 = ExplodeTree(Data=shift_paths_8)  # -> Branch0, Branch1, Branch2, Branch3
explode_tree_5 = ExplodeTree(Data=shift_paths_9)  # -> Branch0, Branch1, Branch2, Branch3
entwine_4 = Entwine(
    Branch00=explode_tree_4.Branch0,
    Branch01=explode_tree_4.Branch1,
    Branch02=explode_tree_4.Branch2,
    Branch03=explode_tree_4.Branch3,
    FlattenInputs=True)
entwine_5 = Entwine(
    Branch00=explode_tree_5.Branch0,
    Branch01=explode_tree_5.Branch1,
    Branch02=explode_tree_5.Branch2,
    Branch03=explode_tree_5.Branch3,
    FlattenInputs=True)
entwine_6 = Entwine(
    Branch00=reverse(divide_length_3.Parameters),
    Branch01=divide_length.Parameters,
    Branch02=reverse(divide_length_4.Parameters),
    Branch03=divide_length_2.Parameters,
    FlattenInputs=True)
vec2pt_2 = Vector2Pt(PointA=Point(0, 0, 0), PointB=entwine_3, Unitize=False)  # -> Vector, Length
cluster_2 = Cluster_9(curve=curve, parameter=entwine_6)  # -> a, plane
cluster_3 = Cluster_8(G=entwine_5, T=vec2pt_2.Vector)  # -> G_2, P
cluster_4 = Cluster_8(G=entwine_4, T=vec2pt_2.Vector)  # -> G_2, P
rotate_2 = Rotate(Geometry=cluster_3.G_2, Angle=cluster_2.a, Plane=cluster_2.plane)  # -> Geometry, Transform
rotate_3 = Rotate(Geometry=cluster_4.G_2, Angle=cluster_2.a, Plane=cluster_2.plane)  # -> Geometry, Transform
loft_2 = Loft(
    Curves=rotate_3.Geometry,
    Options={Adjust=False, Closed=False, LoftEnds=0, LoftSimp=0, LoftType=0, Rebuild=10, Refit=0.01})
loft_3 = Loft(
    Curves=rotate_2.Geometry,
    Options={Adjust=False, Closed=False, LoftEnds=0, LoftSimp=0, LoftType=0, Rebuild=10, Refit=0.01})

# ---- group: FSM
list_item_11 = ListItem(List=divide_curve_2.Parameters, Index=sort_points_3.Indices, Wrap=True)
list_item_12 = ListItem(List=divide_curve.Parameters, Index=sort_points_4.Indices, Wrap=True)
shift_paths_10 = ShiftPaths(Data=cullpt_2.Points, Offset=expr("-1", -2))
shift_paths_11 = ShiftPaths(Data=cullpt.Points, Offset=expr("-1", -2))
merge_15 = Merge(Data1=simplify(list_item_11), Data2=simplify(list_item_12))
split_tree_3 = SplitTree(Data=shift_paths_10, Masks=flatten("{0;*}"))  # -> Positive, Negative
split_tree_4 = SplitTree(Data=shift_paths_11, Masks=flatten("{0;*}"))  # -> Positive, Negative
tree_statistics_2 = TreeStatistics(Tree=split_tree_3.Positive)  # -> Paths, Length, Count
tree_statistics_3 = TreeStatistics(Tree=split_tree_4.Positive)  # -> Paths, Length, Count
construct_point_3 = ConstructPoint(XCoordinate=merge_15, YCoordinate=0, ZCoordinate=0)
list_item_13 = ListItem(List=tree_statistics_2.Paths, Index=expr("-1", tree_statistics_2.Count), Wrap=True)
split_tree_5 = SplitTree(Data=split_tree_3.Positive, Masks=flatten(list_item_13))  # -> Positive, Negative
list_item_14 = ListItem(List=tree_statistics_3.Paths, Index=expr("-1", tree_statistics_3.Count), Wrap=True)
cull_duplicates_5 = CullDuplicates(Points=construct_point_3, Tolerance=0.1, CullMode=3)  # -> Points, Indices, Valence
split_tree_6 = SplitTree(Data=split_tree_4.Positive, Masks=flatten(list_item_14))  # -> Positive, Negative
pline_3 = PolyLine(Vertices=split_tree_5.Positive, Closed=True)  # -> flatten(Polyline)
sort_points_9 = SortPoints(Points=cull_duplicates_5.Points)  # -> Points, Indices
vec2pt_3 = Vector2Pt(PointA=Point(0, 0, 0), PointB=merge_10, Unitize=False)  # -> Vector, Length
pline_4 = PolyLine(Vertices=split_tree_6.Positive, Closed=True)  # -> flatten(Polyline)
cull_duplicates_6 = CullDuplicates(Points=vec2pt_3.Vector, Tolerance=0.1, CullMode=3)  # -> simplify(Points), Indices, Valence
deconstruct = Deconstruct(Point=sort_points_9.Points)  # -> simplify(XComponent), YComponent, ZComponent
sort_points_10 = SortPoints(Points=cull_duplicates_6.Points)  # -> Points, Indices
cluster_5 = Cluster_8(G=pline_4, T=sort_points_10.Points)  # -> G_2, P
cluster_6 = Cluster_9(curve=curve, parameter=deconstruct.XComponent)  # -> a, plane
cluster_7 = Cluster_8(G=pline_3, T=sort_points_10.Points)  # -> G_2, P
rotate_4 = Rotate(Geometry=cluster_5.G_2, Angle=cluster_6.a, Plane=cluster_6.plane)  # -> Geometry, Transform
rotate_5 = Rotate(Geometry=cluster_7.G_2, Angle=cluster_6.a, Plane=cluster_6.plane)  # -> Geometry, Transform
loft_4 = Loft(
    Curves=rotate_5.Geometry,
    Options={Adjust=False, Closed=False, LoftEnds=0, LoftSimp=0, LoftType=0, Rebuild=10, Refit=0.01})
loft_5 = Loft(
    Curves=rotate_4.Geometry,
    Options={Adjust=False, Closed=False, LoftEnds=0, LoftSimp=0, LoftType=0, Rebuild=10, Refit=0.01})

# ---- group: PierTable
list_length_3 = ListLength(List=explode.Vertices)
shift_paths_12 = ShiftPaths(Data=cullpt_2.Points, Offset=expr("-1", -2))
shift_paths_13 = ShiftPaths(Data=cullpt.Points, Offset=expr("-1", -2))
shift_paths_14 = ShiftPaths(Data=evaluate_length_3.Parameter, Offset=-1)
partition_list_2 = PartitionList(List=explode.Vertices, Size=expr("x/2", list_length_3))
split_tree_7 = SplitTree(Data=shift_paths_12, Masks=flatten("{0;*}"))  # -> Positive, Negative
split_tree_8 = SplitTree(Data=shift_paths_13, Masks=flatten("{0;*}"))  # -> Positive, Negative
merge_16 = Merge(Data1=graft(evaluate_length.Parameter), Data2=evaluate_length_2.Parameter, Data3=shift_paths_14)
tree_statistics_4 = TreeStatistics(Tree=split_tree_7.Positive)  # -> Paths, Length, Count
tree_statistics_5 = TreeStatistics(Tree=split_tree_8.Positive)  # -> Paths, Length, Count
split_tree_9 = SplitTree(Data=partition_list_2, Masks=flatten("{*;0}"))  # -> reverse(Positive), Negative
list_item_15 = ListItem(List=merge_16, Index=sort_points.Indices, Wrap=True)
list_item_16 = ListItem(List=tree_statistics_4.Paths, Index=expr("0", tree_statistics_4.Count), Wrap=True)
list_length_4 = ListLength(List=list_item_15)
split_tree_10 = SplitTree(Data=split_tree_7.Positive, Masks=flatten(list_item_16))  # -> Positive, Negative
list_item_17 = ListItem(List=split_tree_9.Positive, Index=0, Wrap=True)
list_item_18 = ListItem(List=tree_statistics_5.Paths, Index=expr("0", tree_statistics_5.Count), Wrap=True)
split_tree_11 = SplitTree(Data=split_tree_8.Positive, Masks=flatten(list_item_18))  # -> Positive, Negative
division_6 = Division(A=list_length_4, B=2)
list_item_19 = ListItem(List=list_item_15, Index=expr("x-1", division_6), Wrap=True)
insert_items = InsertItems(List=split_tree_9.Negative, Item=list_item_17, Indices=0, Wrap=True)
pline_5 = PolyLine(Vertices=split_tree_10.Positive, Closed=True)  # -> flatten(Polyline)
pline_6 = PolyLine(Vertices=split_tree_11.Positive, Closed=True)  # -> flatten(Polyline)
insert_items_2 = InsertItems(List=list_item_15, Item=list_item_19, Indices=division_6, Wrap=True)
shift_paths_15 = ShiftPaths(Data=insert_items, Offset=-1)
merge_17 = Merge(Data1=split_tree_9.Positive, Data2=shift_paths_15)
shift_paths_16 = ShiftPaths(Data=insert_items_2, Offset=-1)
list_length_5 = ListLength(List=shift_paths_16)
partition_list_3 = PartitionList(List=shift_paths_16, Size=expr("x/2", list_length_5))
split_tree_12 = SplitTree(Data=partition_list_3, Masks=flatten("{*;0}"))  # -> reverse(Positive), Negative
vec2pt_4 = Vector2Pt(PointA=Point(0, 0, 0), PointB=merge_17, Unitize=False)  # -> Vector, Length
merge_18 = Merge(Data1=split_tree_12.Positive, Data2=split_tree_12.Negative)
cluster_8 = Cluster_8(G=pline_5, T=vec2pt_4.Vector)  # -> G_2, P
cluster_9 = Cluster_8(G=pline_6, T=vec2pt_4.Vector)  # -> G_2, P
path_mapper = PathMapper(merge_18, source="{x;y;z}", target="{y;z}")
cluster_10 = Cluster_9(curve=curve, parameter=path_mapper)  # -> a, plane
rotate_6 = Rotate(Geometry=cluster_9.G_2, Angle=cluster_10.a, Plane=cluster_10.plane)  # -> Geometry, Transform
rotate_7 = Rotate(Geometry=cluster_8.G_2, Angle=cluster_10.a, Plane=cluster_10.plane)  # -> Geometry, Transform
loft_6 = Loft(
    Curves=rotate_7.Geometry,
    Options={Adjust=False, Closed=False, LoftEnds=0, LoftSimp=0, LoftType=0, Rebuild=10, Refit=0.01})
loft_7 = Loft(
    Curves=rotate_6.Geometry,
    Options={Adjust=False, Closed=False, LoftEnds=0, LoftSimp=0, LoftType=0, Rebuild=10, Refit=0.01})

# ---- group: KeySeg
shift_paths_17 = ShiftPaths(Data=cullpt.Points, Offset=expr("-1", -2))
shift_paths_18 = ShiftPaths(Data=cullpt_2.Points, Offset=expr("-1", -2))
split_tree_13 = SplitTree(Data=shift_paths_17, Masks=flatten("{0;*}"))  # -> Positive, Negative
split_tree_14 = SplitTree(Data=shift_paths_18, Masks=flatten("{0;*}"))  # -> Positive, Negative
tree_statistics_6 = TreeStatistics(Tree=split_tree_13.Positive)  # -> Paths, Length, Count
tree_statistics_7 = TreeStatistics(Tree=split_tree_14.Positive)  # -> Paths, Length, Count
list_item_20 = ListItem(List=tree_statistics_6.Paths, Index=expr("-1", tree_statistics_6.Count), Wrap=True)
split_tree_15 = SplitTree(Data=split_tree_13.Positive, Masks=flatten(list_item_20))  # -> Positive, Negative
list_item_21 = ListItem(List=tree_statistics_7.Paths, Index=expr("-1", tree_statistics_7.Count), Wrap=True)
split_tree_16 = SplitTree(Data=split_tree_14.Positive, Masks=flatten(list_item_21))  # -> Positive, Negative
pline_7 = PolyLine(Vertices=split_tree_15.Positive, Closed=True)  # -> flatten(Polyline)
pline_8 = PolyLine(Vertices=split_tree_16.Positive, Closed=True)  # -> flatten(Polyline)
merge_19 = Merge(Data1=graft(evaluate_length_4.Parameter), Data2=evaluate_length_5.Parameter)
vec2pt_5 = Vector2Pt(PointA=Point(0, 0, 0), PointB=explode_3.Vertices, Unitize=False)  # -> Vector, Length
list_item_22 = ListItem(List=merge_19, Index=sort_points_2.Indices, Wrap=True)
cluster_11 = Cluster_9(curve=curve, parameter=list_item_22)  # -> simplify(a), simplify(plane)
cluster_12 = Cluster_8(G=pline_8, T=vec2pt_5.Vector)  # -> G_2, P
cluster_13 = Cluster_8(G=pline_7, T=vec2pt_5.Vector)  # -> G_2, P
rotate_8 = Rotate(Geometry=cluster_13.G_2, Angle=cluster_11.a, Plane=cluster_11.plane)  # -> Geometry, Transform
rotate_9 = Rotate(Geometry=cluster_12.G_2, Angle=cluster_11.a, Plane=cluster_11.plane)  # -> Geometry, Transform
loft_8 = Loft(
    Curves=rotate_8.Geometry,
    Options={Adjust=False, Closed=False, LoftEnds=0, LoftSimp=0, LoftType=0, Rebuild=10, Refit=0.01})
loft_9 = Loft(
    Curves=rotate_9.Geometry,
    Options={Adjust=False, Closed=False, LoftEnds=0, LoftSimp=0, LoftType=0, Rebuild=10, Refit=0.01})

# ---- group: Max Segement Count
cluster_14 = Cluster_2(tree=entwine_2, data=entwine_2)  # -> tree_2, tree_3
number_slider_22 = Slider(0, range=0..100)
tree_statistics_8 = TreeStatistics(Tree=cluster_14.tree_3)  # -> Paths, Length, Count
tree_statistics_9 = TreeStatistics(Tree=cluster_14.tree_2)  # -> Paths, Length, Count
list_item_23 = ListItem(List=tree_statistics_8.Paths, Index=number_slider_22, Wrap=True)
list_item_24 = ListItem(List=tree_statistics_9.Paths, Index=number_slider_22, Wrap=True)
split_tree_17 = SplitTree(Data=cluster_14.tree_2, Masks=flatten(list_item_24))  # -> Positive, Negative
split_tree_18 = SplitTree(Data=cluster_14.tree_3, Masks=flatten(list_item_23))  # -> Positive, Negative
merge_20 = Merge(Data1=tree_statistics_9.Count, Data2=tree_statistics_8.Count)
# Parameter
sort_list = SortList(Keys=merge_20)  # -> Keys, ValuesValuesA
list_item_25 = ListItem(List=sort_list.Keys, Index=-1, Wrap=True)

# ----
# 3-6-A. Construction Step
# a. Segment Construction Step
segment_construction_step = Panel(list_item_25)
addition_7 = Addition(A=flatten(segment_construction_step), B=after_segment_consturction_step)
series_3 = Series(Start=1, Step=1, Count=addition_7)
duplicate_data = DuplicateData(Data=addition_6, Number=segment_construction_step, Order=True)  # -> flatten(Data)
duplicate_data_2 = DuplicateData(Data=_1_segment_date_2, Number=segment_construction_step, Order=True)  # -> flatten(Data)
concatenate = Concatenate(FragmentA="CS", FragmentB=series_3)  # -> flatten(Result)
merge_21 = Merge(
    Data1=duplicate_data_2,
    Data2=key_segment_date_2,
    Data3=working_date,
    Data4=key_segment_date_2,
    Data5=working_date,
    Data6=working_date)
merge_22 = Merge(Data1=duplicate_data, Data2=addition_5, Data3=working_date, Data4=addition_5, Data5=working_date, Data6=date)
# Additional Step Duration
panel_13 = Panel(merge_21)
# Duration
panel_14 = Panel(merge_22)
# Stage Name
panel_15 = Panel(concatenate)

subtraction_7 = Subtraction(A=evaluate_2, B=evaluate_4, C=0.225)
outer_dimension_of_psc_shape = OuterDimensionOfPSCShape(
    HO1=ho1,
    HO2=ho2,
    HO21=ho2_1,
    HO3=evaluate_2,
    BO1=bo1,
    BO11=bo1_1,
    BO2=bo2,
    BO3=bo3,
    prevData_itemkey=[0, 0, 0, 0, 0, 0, 0, 0, 0, 0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],
    prevData_key=[0, 1, 2, 3, 4, 5, 6, 7, 8, 9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])
inner_dimension_of_psc_shape = InnerDimensionOfPSCShape(
    HI1=hi1,
    HI2=hi2,
    HI21=hi2_1,
    HI3=evaluate_4,
    HI4=number_slider,
    HI41=number_slider_2,
    HI5=subtraction_7,
    BI1=number_slider_3,
    BI11=number_slider_4,
    BI3=number_slider_5,
    BI31=number_slider_6,
    BI42CELLOnly=Slider(0, range=0..10),
    prevData_itemkey=[0, 0, 0, 0, 0, 0, 0, 0, 0, 0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],
    prevData_key=[0, 1, 2, 3, 4, 5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])

# ----
# d. Section Shape
# Tapered Shape
# PSC Shape
psc_shape_1_2cell = PSCShape12Cell(
    OuterDimension=outer_dimension_of_psc_shape,
    InnerDimension=inner_dimension_of_psc_shape,
    ShearCheck=shear_check_of_psc_shape,
    WebThickForShear=web_thick_for_shear_of_psc_shape,
    prevData_itemkey=[0, 0, 0, 0, 0, 0, 0, 0, 0, 0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],
    prevData_key=[0, 1, 2, 3, 4, 5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])  # -> reverse(PSCShape12Cell)
explode_tree_6 = ExplodeTree(Data=psc_shape_1_2cell)  # -> Branch0, Branch1, Branch2, Branch3
cluster_15 = Cluster(data=explode_tree_6.Branch0)  # -> list_2, list
cluster_16 = Cluster(data=explode_tree_6.Branch1)  # -> list_2, list
cluster_17 = Cluster(data=explode_tree_6.Branch2)  # -> list_2, list
cluster_18 = Cluster(data=explode_tree_6.Branch3)  # -> list_2, list
tapered_shape_psc_1_2cell = TaperedShapePSC12Cell(
    PSCShapeForI=cluster_15.list,
    PSCShapeForJ=cluster_15.list_2,
    prevData_itemkey=[0, 0, 0, 0, 0, 0, 0, 0, 0, 0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],
    prevData_key=[0, 1, 2, 3, 4, 5, 6, 7, 8, 9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])
tapered_shape_psc_1_2cell_2 = TaperedShapePSC12Cell(
    PSCShapeForI=cluster_16.list_2,
    PSCShapeForJ=cluster_16.list,
    prevData_itemkey=[0, 0, 0, 0, 0, 0, 0, 0, 0, 0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],
    prevData_key=[0, 1, 2, 3, 4, 5, 6, 7, 8, 9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])
tapered_shape_psc_1_2cell_3 = TaperedShapePSC12Cell(
    PSCShapeForI=cluster_17.list,
    PSCShapeForJ=cluster_17.list_2,
    prevData_itemkey=[0, 0, 0, 0, 0, 0, 0, 0, 0, 0, 0, 0, 0, 0, 0, 0, 0, 0, 0, 0, 0, 0, 0, 0, 0],
    prevData_key=[0, 1, 2, 3, 4, 5, 6, 7, 8, 9, 10, 11, 12, 13, 14, 15, 16, 17, 18, 19, 20, 21, 22, 23, 24])
tapered_shape_psc_1_2cell_4 = TaperedShapePSC12Cell(
    PSCShapeForI=cluster_18.list_2,
    PSCShapeForJ=cluster_18.list,
    prevData_itemkey=[0, 0, 0, 0, 0, 0, 0, 0, 0, 0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],
    prevData_key=[0, 1, 2, 3, 4, 5, 6, 7, 8, 9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])

list_length_6 = ListLength(List=tapered_shape_psc_1_2cell)
list_length_7 = ListLength(List=tapered_shape_psc_1_2cell_2)
list_length_8 = ListLength(List=tapered_shape_psc_1_2cell_3)
list_length_9 = ListLength(List=tapered_shape_psc_1_2cell_4)
series_4 = Series(Start=1, Step=1, Count=list_length_6)
series_5 = Series(Start=1, Step=1, Count=list_length_7)
series_6 = Series(Start=1, Step=1, Count=list_length_8)
series_7 = Series(Start=1, Step=1, Count=list_length_9)
concatenate_2 = Concatenate(FragmentA="(L)Span-Support", FragmentB=series_4)
concatenate_3 = Concatenate(FragmentA="(L)Support-Span", FragmentB=series_5)
concatenate_4 = Concatenate(FragmentA="(R)Span-Support", FragmentB=series_6)
concatenate_5 = Concatenate(FragmentA="(R)Support-Span", FragmentB=series_7)
entwine_7 = Entwine(Branch00=concatenate_2, Branch01=concatenate_3, Branch02=concatenate_4, Branch03=concatenate_5, FlattenInputs=True)
entwine_8 = Entwine(
    Branch00=tapered_shape_psc_1_2cell,
    Branch01=tapered_shape_psc_1_2cell_2,
    Branch02=tapered_shape_psc_1_2cell_3,
    Branch03=tapered_shape_psc_1_2cell_4,
    FlattenInputs=True)
tree_statistics_10 = TreeStatistics(Tree=entwine_7)  # -> flatten(Paths), Length, Count
characters = Characters(Text=tree_statistics_10.Paths)  # -> Result, Unicode
list_length_10 = ListLength(List=entwine_7)
list_item_26 = ListItem(List=characters.Result, Index=3, Wrap=True)
series_8 = Series(Start=expr("x*100+100", list_item_26), Step=1, Count=list_length_10)
list_item_27 = ListItem(List=explode_tree_6.Branch1, Index=expr("0", 0), Wrap=True)
list_item_28 = ListItem(List=explode_tree_6.Branch0, Index=expr("x-1", 0), Wrap=True)
shift_paths_19 = ShiftPaths(Data=series_8, Offset=-1)
section_2 = Section(
    SectionID=shift_paths_19,
    SectionName=entwine_7,
    Shape=entwine_8,
    ChangeOffset=change_offset,
    AdditionalOption=additional_option,
    prevData_itemkey=[100, 101, 102, 103, 302, 301, 300, 220, 219, 218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],
    prevData_key=[0, 1, 2, 3, 45, 44, 43, 42, 41, 40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])
section_3 = Section(
    SectionID=number_slider_20,
    SectionName="Span",
    Shape=list_item_28,
    ChangeOffset=change_offset,
    AdditionalOption=additional_option,
    prevData_itemkey=2,
    prevData_key=0)
section_4 = Section(
    SectionID=number_slider_21,
    SectionName="Support",
    Shape=list_item_27,
    ChangeOffset=change_offset,
    AdditionalOption=additional_option,
    prevData_itemkey=3,
    prevData_key=0)
get_property_9 = GetProperty(DATA=section_2)  # -> Command, ID, SECT_NAME, SECTTYPE, SECT_BEFORE
get_property_10 = GetProperty(DATA=section_3)  # -> Command, ID, SECT_NAME, SECTTYPE, SECT_BEFORE
get_property_11 = GetProperty(DATA=section_4)  # -> Command, ID, SECT_NAME, SECTTYPE, SECT_BEFORE

# ---- group: Sect Property
panel_16 = Panel(get_property_9.ID)
concatenate_6 = Concatenate(FragmentA="/OPE/SECTPROP/", FragmentB=panel_16)  # -> graft(Result)
send_request_3 = SendRequest(COMMAND=concatenate_6, METHOD="GET")  # -> RESULT, ADDRESS
text_split = TextSplit(Text=send_request_3.RESULT, Separators="[]")
list_item_29 = ListItem(List=text_split, Index=Slider(4, range=0..10), Wrap=True)
text_split_2 = TextSplit(Text=list_item_29, Separators=",")
replace_text = ReplaceText(Text=text_split_2, Find="\"", RecursiveReplace=False)
list_item_30 = ListItem(List=replace_text, Index=1, Wrap=True)  # -> simplify(Item)
list_item_31 = ListItem(List=replace_text, Index=2, Wrap=True)  # -> simplify(Item)
number_2 = Number(list_item_31)
number_3 = Number(list_item_30)
expression = Expression(x=number_3, y=number_2, Expression="(x+y)/2")

# ----
midas_merge_data = MidasMergeData(
    DATA1=section,
    DATA2=section_2,
    DATA3=section_3,
    DATA4=section_4,
    DATA5=concreate_material_2,
    DATA6=concreate_material,
    DATA7=user_material,
    DATA8=creep_shrinkage,
    DATA9=comp_strength,
    DATA10=creep_shrinkage_2,
    DATA11=comp_strength_2,
    DATA12=time_dependent_material_link,
    DATA13=time_dependent_material_link_2)  # -> SECT, MATL, TDMT, TDME, TMAT
midas_model_builder = MidasModelBuilder(
    DATA1=midas_merge_data.SECT,
    DATA2=midas_merge_data.MATL,
    DATA3=midas_merge_data.TDMT,
    DATA4=midas_merge_data.TDME,
    DATA5=midas_merge_data.TMAT)

# ----
# PierTable
# a. Name
# Pier Table
# KeySeg
# a. Name
# KeySeg
# a. Name
# FSM
# FSM
# a. Name
# Segment (P1)
# Segment
# Segment (P2)
# a. Name
# Pier
# Pier
number_slider_23 = Slider(2, range=1..10)
data_10 = Data(flatten(get_property_10.ID))
data_11 = Data(flatten(get_property_10.ID))
data_12 = Data(flatten(get_property_8.ID))
data_13 = Data(flatten(get_property_11.ID))
data_14 = Data(get_property_9.ID)
curve_8 = Curve(explode_3.Segments)
curve_9 = Curve(merge_9)
line_4 = Line(entwine_2)
curve_10 = Curve(shift_paths_2)
curve_11 = Curve(merge_4)
beam = Beam(
    MaterialID=number_slider_23,
    SectionID=data_10,
    Line=curve_8,
    prevData_itemkey=[13, 14, 15, 16, 17, 18],
    prevData_key=[0, 1, 2, 3, 4, 5])  # -> Node, Beam
beam_2 = Beam(
    MaterialID=Slider(2, range=1..10),
    SectionID=data_11,
    Line=curve_9,
    prevData_itemkey=[19, 20, 21, 22, 23, 24, 25, 26, 27, 28, 29, 30],
    prevData_key=[0, 1, 2, 3, 4, 5, 6, 7, 8, 9, 10, 11])  # -> Node, Beam
beam_3 = Beam(
    MaterialID=Slider(2, range=1..10),
    SectionID=data_14,
    Line=line_4,
    prevData_itemkey=[31, 32, 33, 34, 35, 36, 37, 38, 39, 40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],
    prevData_key=[0, 1, 2, 3, 4, 5, 6, 7, 8, 9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])  # -> Node, Beam
beam_4 = Beam(
    MaterialID=Slider(2, range=1..10),
    SectionID=data_13,
    Line=curve_11,
    prevData_itemkey=[1, 2, 3, 4, 5, 6, 7, 8, 9, 10, 11, 12],
    prevData_key=[0, 1, 2, 3, 4, 5, 6, 7, 8, 9, 10, 11])  # -> Node, Beam
beam_5 = Beam(
    MaterialID=Slider(1, range=1..10),
    SectionID=data_12,
    Line=curve_10,
    BetaAngle=degrees,
    prevData_itemkey=[113, 114, 115, 116, 117, 118, 119, 120, 121, 122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],
    prevData_key=[0, 1, 2, 3, 4, 5, 6, 7, 8, 9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])  # -> Node, Beam
get_property_12 = GetProperty(DATA=beam.Beam)  # -> Command, ID, TYPE, MATL, SECT, ANGLE, STYPE, NODE
get_property_13 = GetProperty(DATA=beam_4.Beam)  # -> Command, ID, TYPE, MATL, SECT, ANGLE, STYPE, NODE
get_property_14 = GetProperty(DATA=beam_2.Beam)  # -> Command, ID, TYPE, MATL, SECT, ANGLE, STYPE, NODE
get_property_15 = GetProperty(DATA=beam_5.Beam)  # -> Command, ID, TYPE, MATL, SECT, ANGLE, STYPE, NODE
get_property_16 = GetProperty(DATA=beam_3.Beam)  # -> Command, ID, TYPE, MATL, SECT, ANGLE, STYPE, NODE
midas_get_elem_node = MidasGetElemNode(Elem=beam_3.Beam, Index=Slider(1, range=0..100))
midas_get_elem_node_2 = MidasGetElemNode(Elem=beam_2.Beam, Index=Slider(1, range=0..100))
midas_get_elem_node_3 = MidasGetElemNode(Elem=beam_4.Beam, Index=Slider(1, range=0..1))
flatten_tree = FlattenTree(Tree=get_property_16.ID, Path="{0}")
shift_paths_20 = ShiftPaths(Data=get_property_13.ID, Offset=-1)
flatten_tree_2 = FlattenTree(Tree=get_property_12.ID, Path="{0}")
flatten_tree_3 = FlattenTree(Tree=get_property_14.ID, Path="{0}")
midas_get_elem_node_4 = MidasGetElemNode(Elem=beam.Beam, Index=Slider(1, range=0..100))
flatten_tree_4 = FlattenTree(Tree=get_property_13.ID, Path="{0}")
tree_statistics_11 = TreeStatistics(Tree=get_property_16.ID)  # -> Paths, Length, Count
split_list = SplitList(List=tree_statistics_11.Paths, Index=Slider(2, range=0..10))  # -> ListA, ListB
split_tree_19 = SplitTree(Data=get_property_16.ID, Masks=flatten(split_list.ListA))  # -> Positive, Negative
replace_paths_2 = ReplacePaths(Data=split_tree_19.Negative, Search=split_list.ListB, Replace=split_list.ListA)
integer = Integer(get_property_15.ID)
integer_2 = Integer(get_property_13.ID)
integer_3 = Integer(get_property_14.ID)
integer_4 = Integer(get_property_12.ID)

# ---- group: Element ID Sorting
merge_23 = Merge(
    Data1=flatten(midas_get_elem_node_3),
    Data2=flatten(midas_get_elem_node_4),
    Data3=flatten(midas_get_elem_node_2),
    Data4=flatten(midas_get_elem_node))
get_object = GetObject(MidasObjectName="node", MidasObjectID=merge_23)
merge_24 = Merge(
    Data1=flatten(get_property_13.ID),
    Data2=flatten(get_property_12.ID),
    Data3=flatten(get_property_14.ID),
    Data4=flatten(get_property_16.ID))
get_property_17 = GetProperty(DATA=get_object)  # -> ID, X, Y, Z
construct_point_4 = ConstructPoint(XCoordinate=get_property_17.X, YCoordinate=get_property_17.Y, ZCoordinate=get_property_17.Z)  # -> flatten(Point)
sort_points_11 = SortPoints(Points=construct_point_4)  # -> Points, simplify(Indices)
list_item_32 = ListItem(List=merge_24, Index=sort_points_11.Indices, Wrap=True)

# ---- group: Assign Node ID
midas_get_elem_node_5 = MidasGetElemNode(Elem=beam_3.Beam, Index=Slider(1, range=0..10))  # -> simplify(NodeID)
midas_get_elem_node_6 = MidasGetElemNode(Elem=beam_3.Beam, Index=Slider(2, range=0..10))  # -> simplify(NodeID)
explode_tree_7 = ExplodeTree(Data=midas_get_elem_node_5)  # -> Branch0, Branch1, Branch2, Branch3
explode_tree_8 = ExplodeTree(Data=midas_get_elem_node_6)  # -> Branch0, Branch1, Branch2, Branch3
merge_25 = Merge(Data1=explode_tree_8.Branch0, Data2=explode_tree_7.Branch1, Data3=explode_tree_8.Branch2, Data4=explode_tree_7.Branch3)

# ----
# 3-7 Update
midas_merge_data_2 = MidasMergeData(
    DATA1=beam_4.Node,
    DATA2=beam_4.Beam,
    DATA3=beam.Node,
    DATA4=beam.Beam,
    DATA5=beam_2.Node,
    DATA6=beam_2.Beam,
    DATA7=beam_3.Node,
    DATA8=beam_3.Beam,
    DATA9=beam_5.Node,
    DATA10=beam_5.Beam)  # -> NODE, ELEM
midas_model_builder_2 = MidasModelBuilder(DATA1=midas_merge_data_2.NODE, DATA2=midas_merge_data_2.ELEM)

# ----
# 3-1-G. Structure Group
panel_17 = Panel("""Pier1
Pier2""")
panel_18 = Panel("""FSM1
FSM2""")
panel_19 = Panel("""KeySeg1
KeySeg2
KeySeg3""")
panel_20 = Panel("""PierTable1
PierTable2""")
cluster_19 = Cluster_17(list=split_tree_19.Positive)
flip_matrix = FlipMatrix(Data=split_tree_19.Positive)
flip_matrix_2 = FlipMatrix(Data=replace_paths_2)
cluster_20 = Cluster_17(list=replace_paths_2)
concatenate_7 = Concatenate(FragmentA="P1Seg", FragmentB=cluster_19)  # -> flatten(Result)
concatenate_8 = Concatenate(FragmentA="P2Seg", FragmentB=cluster_20)  # -> flatten(Result)
clean_tree = CleanTree(RemoveNulls=True, RemoveInvalid=True, RemoveEmpty=False, Tree=flip_matrix_2)
clean_tree_2 = CleanTree(RemoveNulls=True, RemoveInvalid=True, RemoveEmpty=False, Tree=flip_matrix)
graft_tree = GraftTree(Tree=panel_18, IncludeEmptyLists=True, IncludeNullItems=True)  # -> simplify(Tree)
graft_tree_2 = GraftTree(Tree=panel_19, IncludeEmptyLists=True, IncludeNullItems=True)  # -> simplify(Tree)
shift_paths_21 = ShiftPaths(Data=integer, Offset=-1)
graft_tree_3 = GraftTree(Tree=concatenate_7, IncludeEmptyLists=True, IncludeNullItems=True)
graft_tree_4 = GraftTree(Tree=concatenate_8, IncludeEmptyLists=True, IncludeNullItems=True)
graft_tree_5 = GraftTree(Tree=panel_17, IncludeEmptyLists=True, IncludeNullItems=True)
graft_tree_6 = GraftTree(Tree=panel_20, IncludeEmptyLists=True, IncludeNullItems=True)  # -> simplify(Tree)
shift_paths_22 = ShiftPaths(Data=integer_2, Offset=-1)

cluster_21 = Cluster_13(start=expr("x-1", Slider(1, range=0..1)), tree=graft_tree_6)
cluster_22 = Cluster_14(number=cluster_21)
cluster_23 = Cluster_13(start=cluster_22, tree=graft_tree_2)
cluster_24 = Cluster_14(number=cluster_23)
cluster_25 = Cluster_13(start=cluster_24, tree=graft_tree)
cluster_26 = Cluster_14(number=cluster_25)
cluster_27 = Cluster_13(start=cluster_26, tree=graft_tree_3)
cluster_28 = Cluster_14(number=cluster_27)
cluster_29 = Cluster_13(start=cluster_28, tree=graft_tree_4)
cluster_30 = Cluster_14(number=cluster_29)
cluster_31 = Cluster_13(start=cluster_30, tree=graft_tree_5)

structure_group = StructureGroup(
    GroupID=cluster_23,
    StructureGroupName=graft_tree_2,
    ElementList=integer_4,
    prevData_itemkey=[3, 4, 5],
    prevData_key=[0, 1, 2])
structure_group_2 = StructureGroup(GroupID=cluster_25, StructureGroupName=graft_tree, ElementList=integer_3, prevData_itemkey=[6, 7], prevData_key=[0, 1])
structure_group_3 = StructureGroup(
    GroupID=cluster_21,
    StructureGroupName=graft_tree_6,
    ElementList=shift_paths_22,
    prevData_itemkey=[1, 2],
    prevData_key=[0, 1])
structure_group_4 = StructureGroup(
    GroupID=cluster_27,
    StructureGroupName=graft_tree_3,
    ElementList=clean_tree_2,
    prevData_itemkey=[8, 20, 19, 18, 17, 16, 15, 14, 13, 12, 11, 10, 9, 28, 27, 26, 25, 24, 23, 22, 21, 29],
    prevData_key=[0, 12, 11, 10, 9, 8, 7, 6, 5, 4, 3, 2, 1, 20, 19, 18, 17, 16, 15, 14, 13, 21])
structure_group_5 = StructureGroup(
    GroupID=cluster_29,
    StructureGroupName=graft_tree_4,
    ElementList=clean_tree,
    prevData_itemkey=[30, 42, 41, 40, 39, 38, 37, 36, 35, 34, 33, 32, 31, 50, 49, 48, 47, 46, 45, 44, 43, 51],
    prevData_key=[0, 12, 11, 10, 9, 8, 7, 6, 5, 4, 3, 2, 1, 20, 19, 18, 17, 16, 15, 14, 13, 21])
structure_group_6 = StructureGroup(
    GroupID=cluster_31,
    StructureGroupName=graft_tree_5,
    ElementList=shift_paths_21,
    prevData_itemkey=[52, 53],
    prevData_key=[0, 1])
get_property_18 = GetProperty(DATA=structure_group_3)  # -> Command, ID, NAME, P_TYPE, E_LIST
get_property_19 = GetProperty(DATA=structure_group)  # -> Command, ID, NAME, P_TYPE, E_LIST
get_property_20 = GetProperty(DATA=structure_group_2)  # -> Command, ID, NAME, P_TYPE, E_LIST
get_property_21 = GetProperty(DATA=structure_group_4)  # -> Command, ID, NAME, P_TYPE, E_LIST
get_property_22 = GetProperty(DATA=structure_group_5)  # -> Command, ID, NAME, P_TYPE, E_LIST
get_property_23 = GetProperty(DATA=structure_group_6)  # -> Command, ID, NAME, P_TYPE, E_LIST
flatten_tree_5 = FlattenTree(Tree=get_property_23.NAME, Path="{0}")
flatten_tree_6 = FlattenTree(Tree=get_property_18.NAME, Path="{0}")
tree_statistics_12 = TreeStatistics(Tree=get_property_19.NAME)  # -> Paths, Length, Count
tree_statistics_13 = TreeStatistics(Tree=get_property_20.NAME)  # -> Paths, Length, Count

# ----
# a.Tendon ID
# Top Tendon
# a.Tendon ID
# Bottom Tendon
cluster_32 = Cluster_22(geometry=line_3, point=panel_11, geometry_2=geometry_pipeline_2, data=length, B=length_2)  # -> geometry_3, geometry_4
cluster_33 = Cluster_22(geometry=line_3, point=panel_11, geometry_2=geometry_pipeline_4, data=length, B=length_2)  # -> geometry_3, geometry_4
cluster_34 = Cluster_22(geometry=line_3, point=panel_11, geometry_2=geometry_pipeline_3, data=length, B=length_2)  # -> geometry_3, geometry_4
cluster_35 = Cluster_22(geometry=line_3, point=panel_11, geometry_2=geometry_pipeline, data=length, B=length_2)  # -> geometry_3, geometry_4
cluster_36 = Cluster_22(geometry=line_3, point=panel_11, geometry_2=geometry_pipeline_5, data=length, B=length_2)  # -> geometry_3, geometry_4
graft_tree_7 = GraftTree(Tree=panel_10, IncludeEmptyLists=True, IncludeNullItems=True)
explode_tree_9 = ExplodeTree(Data=graft_tree_7)  # -> flatten(Branch0), flatten(Branch1)
multiplication_3 = Multiplication(A=fpu_n_mm², B=1000)
multiplication_4 = Multiplication(A=fpy_n_mm², B=1000)
multiplication_5 = Multiplication(A=area_m², B=count_ea)
average = Average(Input=[p1_m, p2_m])
cluster_37 = Cluster_23(geometry=cluster_33.geometry_4, curve_2=line_3, length=average, curve=cluster_33.geometry_4)
number_4 = Number(get_property.ID)
length_7 = Length(Curve=cluster_35.geometry_3)
length_8 = Length(Curve=cluster_32.geometry_3)
length_9 = Length(Curve=cluster_36.geometry_3)
length_10 = Length(Curve=cluster_34.geometry_3)
length_11 = Length(Curve=cluster_33.geometry_3)
post_tension_tendon_property = PostTensionTendonProperty(
    TendonPropertyID=Slider(1, range=0..1),
    TendonName=explode_tree_9.Branch0,
    TendonMaterialID=number_4,
    TotalTendonArea=multiplication_5,
    PostTensionDuctDiameter=diameter_m,
    UltimateStrength=multiplication_3,
    YieldStrength=multiplication_4,
    Curvature=curvature,
    WobbleFrictionFactor=wobble,
    AnchorageSlipBegin=length_m,
    AnchorageSlipEnd=length_m,
    prevData_itemkey=1,
    prevData_key=0)
post_tension_tendon_property_2 = PostTensionTendonProperty(
    TendonPropertyID=Slider(2, range=0..10),
    TendonName=explode_tree_9.Branch1,
    TendonMaterialID=number_4,
    TotalTendonArea=multiplication_5,
    PostTensionDuctDiameter=diameter_m,
    UltimateStrength=multiplication_3,
    YieldStrength=multiplication_4,
    Curvature=curvature,
    WobbleFrictionFactor=wobble,
    AnchorageSlipBegin=length_m,
    AnchorageSlipEnd=length_m,
    prevData_itemkey=2,
    prevData_key=0)
get_property_24 = GetProperty(DATA=post_tension_tendon_property_2)  # -> Command, ID, NAME, TYPE, LT, MATL, AREA, D_AREA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
# Prestress Load
get_property_25 = GetProperty(DATA=post_tension_tendon_property)  # -> Command, ID, NAME, TYPE, LT, MATL, AREA, D_AREA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

number_5 = Number(get_property_24.ID)
number_6 = Number(get_property_24.ID)
number_7 = Number(get_property_25.ID)
number_8 = Number(get_property_24.ID)
number_9 = Number(get_property_25.ID)

# ----
# 3-4-G. Load Group
# a. Name prefix
# Pier Table
# KegSeg
# Segment (P1)
# Segment (P2)
# Permanent Load
panel_21 = Panel("""PS-
FT-""")
# a. Name prefix
panel_22 = Panel("""PS-
WC-""")
# a. Name prefix
panel_23 = Panel("""PS-
FT-
WC-""")
# b. Name
panel_24 = Panel("""Self
2nd
TimeLoad""")
concatenate_9 = Concatenate(FragmentA=panel_21, FragmentB=get_property_18.NAME)  # -> graft(Result)
concatenate_10 = Concatenate(FragmentA=panel_22, FragmentB=get_property_19.NAME)
concatenate_11 = Concatenate(FragmentA=panel_23, FragmentB=graft_tree_3)
concatenate_12 = Concatenate(FragmentA=panel_23, FragmentB=get_property_22.NAME)
flip_matrix_3 = FlipMatrix(Data=concatenate_12)
flip_matrix_4 = FlipMatrix(Data=concatenate_11)

graft_tree_8 = GraftTree(Tree=panel_24, IncludeEmptyLists=True, IncludeNullItems=True)
graft_tree_9 = GraftTree(Tree=concatenate_10, IncludeEmptyLists=True, IncludeNullItems=True)
cluster_38 = Cluster_13(start=expr("x-1", Slider(1, range=0..1)), tree=concatenate_9)
cluster_39 = Cluster_14(number=cluster_38)
graft_tree_10 = GraftTree(Tree=flip_matrix_4, IncludeEmptyLists=True, IncludeNullItems=True)
cluster_40 = Cluster_13(start=cluster_39, tree=graft_tree_9)
cluster_41 = Cluster_14(number=cluster_40)
cluster_42 = Cluster_13(start=cluster_41, tree=graft_tree_10)
cluster_43 = Cluster_14(number=cluster_42)
graft_tree_11 = GraftTree(Tree=flip_matrix_3, IncludeEmptyLists=True, IncludeNullItems=True)
cluster_44 = Cluster_13(start=cluster_43, tree=graft_tree_11)
cluster_45 = Cluster_14(number=cluster_44)
cluster_46 = Cluster_13(start=cluster_45, tree=graft_tree_8)

# ---- group: Center of gravity
addition_8 = Addition(A=evaluate_2, B=ho1, C=ho2)
tree_statistics_14 = TreeStatistics(Tree=addition_8)  # -> Paths, Length, Count
dispatch = Dispatch(List=tree_statistics_14.Paths, DispatchPattern=[True, False])  # -> ListA, ListB
split_tree_20 = SplitTree(Data=addition_8, Masks=flatten(dispatch.ListA))  # -> reverse(Positive), Negative
merge_26 = Merge(Data1=split_tree_20.Positive, Data2=split_tree_20.Negative)
cull_index = CullIndex(List=merge_26, Indices=-1, Wrap=True)  # -> simplify(List)
shift_list = ShiftList(List=merge_26, Shift=1, Wrap=False)  # -> simplify(List)

# ----
# Create Stactic Load Case
# Assign Self Weight
# Assign 2nd Load
# 3-4-E. Form Travelling Load
# Assign CS Time Load
# 3-4-F. Wet Concrete Load
# Assign Wet Concrete Load
# Assign Form Travelling Load
text = Text(panel_9)
static_load_cases = StaticLoadCases(LoadCaseName=text, prevData_itemkey=[1, 2, 3, 4, 5, 6], prevData_key=[0, 1, 2, 3, 4, 5])
get_property_26 = GetProperty(DATA=static_load_cases)  # -> Command, ID, NAME, TYPE
graft_tree_12 = GraftTree(Tree=get_property_26.NAME, IncludeEmptyLists=True, IncludeNullItems=True)
explode_tree_10 = ExplodeTree(Data=graft_tree_12)  # -> Branch0, Branch1, Branch2, Branch3, Branch4, Branch5
length_12 = Length(Curve=entwine_2)  # -> graft(Length)
list_length_11 = ListLength(List=merge_25)
integer_5 = Integer(get_property_15.ID)
entwine_9 = Entwine(Branch00=split_tree_19.Positive, Branch01=split_tree_19.Negative, FlattenInputs=True)  # -> simplify(Result)
path_mapper_2 = PathMapper(integer_5, source="{x;y;z}", target="{y}")
merge_27 = Merge(Data1=shift_paths_20, Data2=get_property_12.ID, Data3=get_property_14.ID, Data4=entwine_9, Data5=path_mapper_2)
explode_tree_11 = ExplodeTree(Data=merge_27)  # -> Branch0, Branch1, Branch2
flatten_tree_7 = FlattenTree(Tree=explode_tree_10.Branch1, Path="{0}")
merge_28 = Merge(Data1=flatten_tree_4, Data2=flatten_tree, Data3=flatten_tree_2, Data4=flatten_tree_3)
flatten_tree_8 = FlattenTree(Tree=explode_tree_11.Branch0, Path="{0}")
negative_3 = Negative(Value=p_kn)
data_15 = Data(fsm_date)
number_10 = Number(w_kn_m)
text_2 = Text(explode_tree_10.Branch0)
number_11 = Number(factor)
integer_6 = Integer(merge_25)
number_12 = Number(merge_25)

# ---- group: Weight
weight_density = Slider(24, range=0..100)
path_mapper_3 = PathMapper(length_12, source="{x;y;z}", target="{y;z}")
multiplication_6 = Multiplication(A=weight_density, B=path_mapper_3, C=expression)

# ---- group: Center of gravity (continued)
shift_paths_23 = ShiftPaths(Data=path_mapper_3, Offset=-1)
expression_2 = Expression(a=cull_index, b=shift_list, h=shift_paths_23, Expression="h/3*(2*b+a)/(a+b)")  # -> graft(Result)

# ---- group: Consideration of rotation
evaluate_curve = EvaluateCurve(Curve=reparameterize(entwine_2), Parameter=Slider(1, range=0..1))  # -> Point, graft(Tangent), Angle
path_mapper_4 = PathMapper(evaluate_curve.Tangent, source="{x;y;z}", target="{y;z}")
multiplication_7 = Multiplication(A=multiplication_6, B=expression_2, C=path_mapper_4)
deconstruct_vector_2 = DeconstructVector(Vector=multiplication_7)  # -> XComponent, YComponent, ZComponent

# ----
text_3 = Text(flatten(explode_tree_10.Branch4))
text_4 = Text(flatten(explode_tree_10.Branch5))

# ----
# 3-3-A. Support
# Support of Abutment
# Support of Pier
# 3-3-B. Elastic Link
# Bridge - Pier Link
number_slider_24 = Slider(1, range=1..2)
midas_get_elem_node_7 = MidasGetElemNode(Elem=beam_2.Beam, Index=number_slider_24)
midas_get_elem_node_8 = MidasGetElemNode(Elem=beam_2.Beam, Index=Slider(2, range=1..2))
explode_tree_12 = ExplodeTree(Data=midas_get_elem_node_8)  # -> Branch0, Branch1
explode_tree_13 = ExplodeTree(Data=midas_get_elem_node_7)  # -> Branch0, Branch1
midas_get_elem_node_9 = MidasGetElemNode(Elem=beam_5.Beam, Index=Slider(1, range=1..2))
set_difference = SetDifference(SetA=explode_tree_12.Branch1, SetB=explode_tree_13.Branch1)
# 3-3 Boundary
set_difference_2 = SetDifference(SetA=explode_tree_13.Branch0, SetB=explode_tree_12.Branch0)
list_item_33 = ListItem(List=midas_get_elem_node_9, Index=0, Wrap=True)
data_16 = Data(move.Geometry)
data_17 = Data(evaluate_length_2.Point)
data_18 = Data(degrees)
midas_get_node = MidasGetNode(Point=data_16)
midas_get_node_2 = MidasGetNode(Point=data_17)
shift_paths_24 = ShiftPaths(Data=data_18, Offset=-1)
merge_29 = Merge(Data1=set_difference_2, Data2=set_difference)
shift_paths_25 = ShiftPaths(Data=list_item_33, Offset=-2)
data_19 = Data(merge_29)
data_20 = Data(shift_paths_25)
integer_7 = Integer(midas_get_node)
integer_8 = Integer(midas_get_node_2)
number_13 = Number(shift_paths_24)

# ----
# 3-3-C. Boundary Group
# Abutment
# a. Name prefix
# pier
panel_25 = Panel("BC-")
concatenate_13 = Concatenate(FragmentA=panel_25, FragmentB=get_property_20.NAME)  # -> graft(Result)
concatenate_14 = Concatenate(FragmentA=panel_25, FragmentB=get_property_23.NAME)  # -> graft(Result)

cluster_47 = Cluster_13(start=expr("x-1", Slider(1, range=0..1)), tree=concatenate_13)
cluster_48 = Cluster_14(number=cluster_47)
cluster_49 = Cluster_13(start=cluster_48, tree=concatenate_14)

boundary_group = BoundaryGroup(GroupID=cluster_47, BoundaryGroupName=concatenate_13, prevData_itemkey=[1, 2], prevData_key=[0, 1])
boundary_group_2 = BoundaryGroup(GroupID=cluster_49, BoundaryGroupName=concatenate_14, prevData_itemkey=[3, 4], prevData_key=[0, 1])
get_property_27 = GetProperty(DATA=boundary_group)  # -> Command, ID, NAME, AUTOTYPE
get_property_28 = GetProperty(DATA=boundary_group_2)  # -> Command, ID, NAME, AUTOTYPE
shift_paths_26 = ShiftPaths(Data=get_property_28.NAME, Offset=-1)
# 3-4 Static Load
flatten_tree_9 = FlattenTree(Tree=get_property_28.NAME, Path="{0}")

data_21 = Data(get_property_27.NAME)
data_22 = Data(shift_paths_26)
data_23 = Data(shift_paths_26)
supports = Supports(NodeID=data_19, BoundaryGroupName=data_21, prevData_itemkey=[102, 110], prevData_key=[0, 1], prevData_subid0=[1, 1])
supports_2 = Supports(
    NodeID=data_20,
    BoundaryGroupName=data_22,
    prevData_itemkey=[114, 125, 136, 147],
    prevData_key=[0, 1, 2, 3],
    prevData_subid0=[1, 1, 1, 1])
rigid_elastic_link = RigidElasticLink(
    BoundaryGroupName=data_23,
    Node1=integer_7,
    Node2=integer_8,
    BetaAngle=number_13,
    prevData_itemkey=[1, 2, 3, 4],
    prevData_key=[0, 1, 2, 3])

merge_30 = Merge(
    Data1=flatten(explode.Vertices),
    Data2=flatten(explode_3.Vertices),
    Data3=flatten(explode_5.Vertices),
    Data4=flatten(explode_4.Vertices),
    Data5=flatten(explode_9.Vertices),
    Data6=flatten(explode_7.Vertices),
    Data7=flatten(explode_10.Vertices),
    Data8=flatten(explode_8.Vertices))
cluster_50 = Cluster_18(points=merge_30, curve=curve)
data_24 = Data(p2_m)
curve_12 = Curve(cluster_32.geometry_4)
cluster_51 = Cluster_19(curve=cluster_32.geometry_3, curve_3=curve_12, A=length_8, number=cluster_50)  # -> tree, result
path_mapper_5 = PathMapper(cluster_51.tree, source="{x;y;z}", target="{x;z;y}")
shift_paths_27 = ShiftPaths(Data=path_mapper_5, Offset=-1)
curve_13 = Curve(curve)

# ---- group: Find the distance from the reference point
cluster_52 = Cluster_10(curve=curve_12, A=data_24)  # -> x_component, result

# ----
list_item_34 = ListItem(List=cluster_51.tree, Index=-1, Wrap=True)

text_5 = Text(cluster_52.result)
text_6 = Text(cluster_52.x_component)
member_index = MemberIndex(Set=flatten(text_5), Member=flatten(text_6))  # -> Index, Count
tree_statistics_15 = TreeStatistics(Tree=member_index.Index)  # -> Paths, Length, Count
split_tree_21 = SplitTree(Data=member_index.Index, Masks=flatten(tree_statistics_15.Paths))  # -> Positive, Negative
list_length_12 = ListLength(List=split_tree_21.Positive)  # -> flatten(Length)

merge_31 = Merge(
    Data1=flatten(explode.Vertices),
    Data2=flatten(explode_3.Vertices),
    Data3=flatten(explode_5.Vertices),
    Data4=flatten(explode_4.Vertices),
    Data5=flatten(explode_9.Vertices),
    Data6=flatten(explode_7.Vertices),
    Data7=flatten(explode_10.Vertices),
    Data8=flatten(explode_8.Vertices))
cluster_53 = Cluster_18(points=merge_31, curve=curve)
data_25 = Data(p1_m)
curve_14 = Curve(cluster_35.geometry_4)
cluster_54 = Cluster_19(curve=cluster_35.geometry_3, curve_3=curve_14, A=length_2, number=cluster_53)  # -> tree, result
path_mapper_6 = PathMapper(cluster_54.tree, source="{x;y;z}", target="{x;z;y}")
shift_paths_28 = ShiftPaths(Data=path_mapper_6, Offset=-1)
curve_15 = Curve(curve)

# ---- group: Find the distance from the reference point
cluster_55 = Cluster_10(curve=curve_14, A=data_25)  # -> x_component, result

# ----
text_7 = Text(cluster_55.result)
text_8 = Text(cluster_55.x_component)
member_index_2 = MemberIndex(Set=flatten(text_7), Member=flatten(text_8))  # -> Index, Count
tree_statistics_16 = TreeStatistics(Tree=member_index_2.Index)  # -> Paths, Length, Count
split_tree_22 = SplitTree(Data=member_index_2.Index, Masks=flatten(tree_statistics_16.Paths))  # -> Positive, Negative
list_length_13 = ListLength(List=split_tree_22.Positive)  # -> flatten(Length)

merge_32 = Merge(
    Data1=flatten(explode.Vertices),
    Data2=flatten(explode_3.Vertices),
    Data3=flatten(explode_5.Vertices),
    Data4=flatten(explode_4.Vertices),
    Data5=flatten(explode_9.Vertices),
    Data6=flatten(explode_7.Vertices),
    Data7=flatten(explode_10.Vertices),
    Data8=flatten(explode_8.Vertices))
cluster_56 = Cluster_18(points=merge_32, curve=curve)
data_26 = Data(p1_m)
curve_16 = Curve(cluster_34.geometry_4)
cluster_57 = Cluster_19(curve=cluster_34.geometry_3, curve_3=curve_16, A=length_10, number=cluster_56)  # -> tree, result
path_mapper_7 = PathMapper(cluster_57.tree, source="{x;y;z}", target="{x;z;y}")
shift_paths_29 = ShiftPaths(Data=path_mapper_7, Offset=-1)
curve_17 = Curve(curve)

# ---- group: Find the distance from the reference point
cluster_58 = Cluster_10(curve=curve_16, A=data_26)  # -> x_component, result

# ----
merge_33 = Merge(
    Data1=flatten(explode.Vertices),
    Data2=flatten(explode_3.Vertices),
    Data3=flatten(explode_5.Vertices),
    Data4=flatten(explode_4.Vertices),
    Data5=flatten(explode_9.Vertices),
    Data6=flatten(explode_7.Vertices),
    Data7=flatten(explode_10.Vertices),
    Data8=flatten(explode_8.Vertices))
cluster_59 = Cluster_18(points=merge_33, curve=curve)
curve_18 = Curve(cluster_37)
data_27 = Data(average)
cluster_60 = Cluster_19(curve=cluster_33.geometry_3, curve_3=curve_18, A=length_11, number=cluster_59)  # -> tree, result
path_mapper_8 = PathMapper(cluster_60.tree, source="{x;y;z}", target="{x;z;y}")
shift_paths_30 = ShiftPaths(Data=path_mapper_8, Offset=-1)
curve_19 = Curve(curve)

# ---- group: Find the distance from the reference point
cluster_61 = Cluster_10(curve=curve_18, A=data_27)  # -> x_component, result

# ----
merge_34 = Merge(
    Data1=flatten(explode.Vertices),
    Data2=flatten(explode_3.Vertices),
    Data3=flatten(explode_5.Vertices),
    Data4=flatten(explode_4.Vertices),
    Data5=flatten(explode_9.Vertices),
    Data6=flatten(explode_7.Vertices),
    Data7=flatten(explode_10.Vertices),
    Data8=flatten(explode_8.Vertices))
cluster_62 = Cluster_18(points=merge_34, curve=curve)
data_28 = Data(p2_m)
curve_20 = Curve(cluster_36.geometry_4)
cluster_63 = Cluster_19(curve=cluster_36.geometry_3, curve_3=curve_20, A=length_9, number=cluster_62)  # -> tree, result
path_mapper_9 = PathMapper(cluster_63.tree, source="{x;y;z}", target="{x;z;y}")
shift_paths_31 = ShiftPaths(Data=path_mapper_9, Offset=-1)
curve_21 = Curve(curve)

# ---- group: Find the distance from the reference point
cluster_64 = Cluster_10(curve=curve_20, A=data_28)  # -> x_component, result

# ----
load_group = LoadGroup(GroupID=cluster_38, LoadGroupName=concatenate_9, prevData_itemkey=[1, 2, 3, 4], prevData_key=[0, 1, 2, 3])
load_group_2 = LoadGroup(GroupID=cluster_40, LoadGroupName=graft_tree_9, prevData_itemkey=[5, 6, 7, 8, 9, 10], prevData_key=[0, 1, 2, 3, 4, 5])
load_group_3 = LoadGroup(
    GroupID=cluster_42,
    LoadGroupName=graft_tree_10,
    prevData_itemkey=[11, 12, 13, 49, 48, 47, 46, 45, 44, 43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],
    prevData_key=[0, 1, 2, 38, 37, 36, 35, 34, 33, 32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])
load_group_4 = LoadGroup(
    GroupID=cluster_44,
    LoadGroupName=graft_tree_11,
    prevData_itemkey=[77, 78, 79, 115, 114, 113, 112, 111, 110, 109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],
    prevData_key=[0, 1, 2, 38, 37, 36, 35, 34, 33, 32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])
load_group_5 = LoadGroup(GroupID=cluster_46, LoadGroupName=graft_tree_8, prevData_itemkey=[143, 144, 145], prevData_key=[0, 1, 2])
get_property_29 = GetProperty(DATA=load_group_5)  # -> Command, ID, NAME
get_property_30 = GetProperty(DATA=load_group_4)  # -> Command, ID, NAME
get_property_31 = GetProperty(DATA=load_group_3)  # -> Command, ID, NAME
get_property_32 = GetProperty(DATA=load_group)  # -> Command, ID, NAME
get_property_33 = GetProperty(DATA=load_group_2)  # -> Command, ID, NAME
path_mapper_10 = PathMapper(get_property_32.NAME, source="{x;y}", target="{y;x}")
shift_paths_32 = ShiftPaths(Data=path_mapper_10, Offset=-1)
explode_tree_14 = ExplodeTree(Data=shift_paths_32)  # -> Branch0, Branch1

shift_paths_33 = ShiftPaths(Data=get_property_30.NAME, Offset=-1)
shift_paths_34 = ShiftPaths(Data=get_property_29.NAME, Offset=-1)
shift_paths_35 = ShiftPaths(Data=get_property_31.NAME, Offset=-1)
path_mapper_11 = PathMapper(get_property_33.NAME, source="{x;y}", target="{y;x}")
graft_tree_13 = GraftTree(Tree=shift_paths_34, IncludeEmptyLists=True, IncludeNullItems=True)
explode_tree_15 = ExplodeTree(Data=shift_paths_35)  # -> flatten(Branch0), flatten(Branch1), flatten(Branch2)
explode_tree_16 = ExplodeTree(Data=shift_paths_33)  # -> flatten(Branch0), flatten(Branch1), flatten(Branch2)
explode_tree_17 = ExplodeTree(Data=graft_tree_13)  # -> Branch0, Branch1, Branch2
graft_tree_14 = GraftTree(Tree=explode_tree_15.Branch1, IncludeEmptyLists=True, IncludeNullItems=True)
graft_tree_15 = GraftTree(Tree=explode_tree_15.Branch2, IncludeEmptyLists=True, IncludeNullItems=True)
graft_tree_16 = GraftTree(Tree=explode_tree_15.Branch0, IncludeEmptyLists=True, IncludeNullItems=True)
graft_tree_17 = GraftTree(Tree=explode_tree_16.Branch1, IncludeEmptyLists=True, IncludeNullItems=True)
graft_tree_18 = GraftTree(Tree=explode_tree_16.Branch2, IncludeEmptyLists=True, IncludeNullItems=True)
graft_tree_19 = GraftTree(Tree=explode_tree_16.Branch0, IncludeEmptyLists=True, IncludeNullItems=True)

shift_paths_36 = ShiftPaths(Data=path_mapper_11, Offset=-1)
explode_tree_18 = ExplodeTree(Data=shift_paths_36)  # -> Branch0, Branch1
list_item_35 = ListItem(List=explode_tree_14.Branch0, Index=0, Wrap=True)
list_item_36 = ListItem(List=explode_tree_14.Branch0, Index=1, Wrap=True)

# ---- group: Assign Group Name
duplicate_data_3 = DuplicateData(Data=explode_tree_16.Branch2, Number=2, Order=True)
duplicate_data_4 = DuplicateData(Data=explode_tree_15.Branch2, Number=2, Order=True)
list_length_14 = ListLength(List=explode_tree_15.Branch2)
list_length_15 = ListLength(List=explode_tree_16.Branch2)
split_list_2 = SplitList(List=duplicate_data_4, Index=list_length_14)  # -> ListA, ListB
split_list_3 = SplitList(List=duplicate_data_3, Index=list_length_15)  # -> ListA, ListB
entwine_10 = Entwine(
    Branch00=split_list_2.ListA,
    Branch01=split_list_2.ListB,
    Branch02=split_list_3.ListA,
    Branch03=split_list_3.ListB,
    FlattenInputs=True)  # -> simplify(Result)
split_list_4 = SplitList(List=entwine_10, Index=list_length_11)  # -> simplify(ListA), ListB

duplicate_data_5 = DuplicateData(Data=graft_tree_17, Number=2, Order=True)
duplicate_data_6 = DuplicateData(Data=graft_tree_14, Number=2, Order=True)
list_length_16 = ListLength(List=explode_tree_15.Branch1)
list_length_17 = ListLength(List=explode_tree_16.Branch1)
split_list_5 = SplitList(List=duplicate_data_6, Index=list_length_16)  # -> ListA, ListB
split_list_6 = SplitList(List=duplicate_data_5, Index=list_length_17)  # -> ListA, ListB
entwine_11 = Entwine(
    Branch00=split_list_5.ListA,
    Branch01=split_list_5.ListB,
    Branch02=split_list_6.ListA,
    Branch03=split_list_6.ListB,
    FlattenInputs=True)  # -> simplify(Result)
split_list_7 = SplitList(List=entwine_11, Index=list_length_11)  # -> simplify(ListA), ListB

# ----
merge_35 = Merge(Data1=explode_tree_18.Branch0)  # -> graft(Result)
explode_tree_19 = ExplodeTree(Data=merge_35)  # -> flatten(Branch0), flatten(Branch1), flatten(Branch2)
merge_36 = Merge(Data1=list_item_35, Data2=explode_tree_15.Branch0)  # -> graft(Result)
merge_37 = Merge(Data1=list_item_36, Data2=explode_tree_16.Branch0)  # -> graft(Result)
merge_38 = Merge(Data1=explode_tree_18.Branch0)  # -> simplify(graft(Result))
data_29 = Data(merge_38)

cluster_65 = Cluster_20(list=curve_12, text=cluster_52.x_component, text_2=cluster_52.result)  # -> i, vertices
cluster_66 = Cluster_21(text=cluster_52.x_component, curve=curve_12, d2=shift_paths_27, A=data_24)
shift_paths_37 = ShiftPaths(Data=cluster_66, Offset=-1)
deconstruct_2 = Deconstruct(Point=shift_paths_37)  # -> XComponent, YComponent, ZComponent
evaluate_length_19 = EvaluateLength(Curve=curve_13, Length=deconstruct_2.XComponent, Normalized=False)  # -> Point, Tangent, Parameter
tree_statistics_17 = TreeStatistics(Tree=cluster_66)  # -> Paths, Length, Count

# ---- group: Make Tendon Name
cluster_67 = Cluster_12(fragment_a="P2", fragment_b="T", tree=simplify(cluster_65.vertices))  # -> data, paths

# ---- group: Find the point location that Tendon should refer to
cluster_68 = Cluster_11(curve=cluster_32.geometry_3, A=deconstruct_2.XComponent)

# ---- group: Move to Point
vector_2pt = Vector2Pt(PointA=cluster_68, PointB=evaluate_length_19.Point, Unitize=False)  # -> Vector, Length
move_5 = Move(Geometry=shift_paths_37, Motion=vector_2pt.Vector)  # -> Geometry, Transform

# ----
cluster_69 = Cluster_16(tree=cluster_68, tree_2=move_5.Geometry, curve=curve, tree_3=deconstruct_2.XComponent)
partition_list_4 = PartitionList(List=cluster_69, Size=tree_statistics_17.Length)

# ---- group: Path Matching
tree_statistics_18 = TreeStatistics(Tree=partition_list_4)  # -> Paths, Length, Count
tree_statistics_19 = TreeStatistics(Tree=cluster_65.vertices)  # -> Paths, Length, Count
replace_paths_3 = ReplacePaths(Data=partition_list_4, Search=tree_statistics_18.Paths, Replace=tree_statistics_19.Paths)  # -> simplify(Data)

# ---- group: Tendon Element ID
list_item_37 = ListItem(List=replace_paths_3, Index=1, Wrap=True)  # -> flatten(Item)
closest_point = ClosestPoint(Point=list_item_37, Cloud=sort_points_11.Points)  # -> ClosestPoint, CPIndex, Distance
list_length_18 = ListLength(List=replace_paths_3)
series_9 = Series(Start=graft(closest_point.CPIndex), Step=1, Count=expr("x-1", list_length_18))  # -> simplify(Series)
list_item_38 = ListItem(List=list_item_32, Index=expr("x-1", series_9), Wrap=True)
tree_statistics_20 = TreeStatistics(Tree=list_item_38)  # -> Paths, Length, Count
replace_paths_4 = ReplacePaths(Data=list_item_38, Search=tree_statistics_20.Paths, Replace=tree_statistics_19.Paths)  # -> simplify(Data)

# ----
point = Point(replace_paths_3)
tendon_profile_item = TendonProfileItem(
    XyOrXyzCoordinate=point,
    prevData_itemkey=[0, 0, 0, 0, 0, 0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],
    prevData_key=[0, 1, 2, 3, 4, 5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])
text_9 = Text(cluster_67.data)
number_14 = Number(replace_paths_4)

cluster_70 = Cluster_20(list=curve_14, text=cluster_55.x_component, text_2=cluster_55.result)  # -> i, vertices
cluster_71 = Cluster_21(text=cluster_55.x_component, curve=curve_14, d2=shift_paths_28, A=data_25)
shift_paths_38 = ShiftPaths(Data=cluster_71, Offset=-1)
deconstruct_3 = Deconstruct(Point=shift_paths_38)  # -> XComponent, YComponent, ZComponent
evaluate_length_20 = EvaluateLength(Curve=curve_15, Length=deconstruct_3.XComponent, Normalized=False)  # -> Point, Tangent, Parameter
tree_statistics_21 = TreeStatistics(Tree=cluster_71)  # -> Paths, Length, Count

# ---- group: Make Tendon Name
cluster_72 = Cluster_12(fragment_a="P1", fragment_b="T", tree=simplify(cluster_70.vertices))  # -> data, paths

# ---- group: Find the point location that Tendon should refer to
cluster_73 = Cluster_11(curve=cluster_35.geometry_3, A=deconstruct_3.XComponent)

# ---- group: Move to Point
vector_2pt_2 = Vector2Pt(PointA=cluster_73, PointB=evaluate_length_20.Point, Unitize=False)  # -> Vector, Length
move_6 = Move(Geometry=shift_paths_38, Motion=vector_2pt_2.Vector)  # -> Geometry, Transform

# ----
cluster_74 = Cluster_16(tree=cluster_73, tree_2=move_6.Geometry, curve=curve, tree_3=deconstruct_3.XComponent)
partition_list_5 = PartitionList(List=cluster_74, Size=tree_statistics_21.Length)

# ---- group: Path Matching
tree_statistics_22 = TreeStatistics(Tree=partition_list_5)  # -> Paths, Length, Count
tree_statistics_23 = TreeStatistics(Tree=cluster_70.vertices)  # -> Paths, Length, Count
replace_paths_5 = ReplacePaths(Data=partition_list_5, Search=tree_statistics_22.Paths, Replace=tree_statistics_23.Paths)  # -> simplify(Data)

# ---- group: Tendon Element ID
list_item_39 = ListItem(List=replace_paths_5, Index=1, Wrap=True)  # -> flatten(Item)
closest_point_2 = ClosestPoint(Point=list_item_39, Cloud=sort_points_11.Points)  # -> ClosestPoint, CPIndex, Distance
list_length_19 = ListLength(List=replace_paths_5)
series_10 = Series(Start=graft(closest_point_2.CPIndex), Step=1, Count=expr("x-1", list_length_19))  # -> simplify(Series)
list_item_40 = ListItem(List=list_item_32, Index=expr("x-1", series_10), Wrap=True)
tree_statistics_24 = TreeStatistics(Tree=list_item_40)  # -> Paths, Length, Count
replace_paths_6 = ReplacePaths(Data=list_item_40, Search=tree_statistics_24.Paths, Replace=tree_statistics_23.Paths)  # -> simplify(Data)

# ----
point_2 = Point(replace_paths_5)
tendon_profile_item_2 = TendonProfileItem(
    XyOrXyzCoordinate=point_2,
    prevData_itemkey=[0, 0, 0, 0, 0, 0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],
    prevData_key=[0, 1, 2, 3, 4, 5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])
text_10 = Text(cluster_72.data)
cluster_75 = Cluster_13(start=expr("x-1", Slider(1, range=0..1)), tree=text_10)
cluster_76 = Cluster_14(number=cluster_75)
cluster_77 = Cluster_13(start=cluster_76, tree=text_9)
cluster_78 = Cluster_14(number=cluster_77)
number_15 = Number(replace_paths_6)
# Pier 1 Top Tendon
_3d_spline_tendon_profile = _3DSplineTendonProfile(
    TendonProfileID=cluster_75,
    TendonName=text_10,
    TendonPropertyID=number_7,
    AssignedElementsID=number_15,
    StraightLengthOfTendonBegin=number_slider_18,
    StraightLengthOfTendonEnd=number_slider_18,
    TransferLengthBegin=number_slider_18,
    TransferLengthEnd=number_slider_18,
    DebondedLengthBegin=number_slider_18,
    DebondedLengthEnd=number_slider_18,
    TendonProfileXyzInputType3D=tendon_profile_item_2,
    prevData_itemkey=[1, 2, 3, 4, 5, 6, 7, 8, 9, 10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],
    prevData_key=[0, 1, 2, 3, 4, 5, 6, 7, 8, 9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])
# Pier 2 Top Tendon
_3d_spline_tendon_profile_2 = _3DSplineTendonProfile(
    TendonProfileID=cluster_77,
    TendonName=text_9,
    TendonPropertyID=number_9,
    AssignedElementsID=number_14,
    StraightLengthOfTendonBegin=number_slider_19,
    StraightLengthOfTendonEnd=number_slider_19,
    TransferLengthBegin=number_slider_19,
    TransferLengthEnd=number_slider_19,
    DebondedLengthBegin=number_slider_19,
    DebondedLengthEnd=number_slider_19,
    TendonProfileXyzInputType3D=tendon_profile_item,
    prevData_itemkey=[39, 40, 41, 42, 43, 44, 45, 46, 47, 48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],
    prevData_key=[0, 1, 2, 3, 4, 5, 6, 7, 8, 9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])
get_property_34 = GetProperty(DATA=_3d_spline_tendon_profile_2)  # -> Command, ID, NAME, TDN_PROP, ELEM, BTP, INPUT, CURVE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
get_property_35 = GetProperty(DATA=_3d_spline_tendon_profile)  # -> Command, ID, NAME, TDN_PROP, ELEM, BTP, INPUT, CURVE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
list_item_41 = ListItem(List=flatten(get_property_35.ID), Index=flatten(split_tree_22.Positive), Wrap=True)
list_item_42 = ListItem(List=flatten(get_property_34.ID), Index=flatten(split_tree_21.Positive), Wrap=True)
partition_list_6 = PartitionList(List=list_item_41, Size=list_length_13)
partition_list_7 = PartitionList(List=list_item_42, Size=list_length_12)
tree_statistics_25 = TreeStatistics(Tree=partition_list_6)  # -> Paths, Length, Count
tree_statistics_26 = TreeStatistics(Tree=partition_list_7)  # -> Paths, Length, Count
split_tree_23 = SplitTree(Data=merge_36, Masks=flatten(tree_statistics_25.Paths))  # -> Positive, Negative
split_tree_24 = SplitTree(Data=merge_37, Masks=flatten(tree_statistics_26.Paths))  # -> Positive, Negative
split_tree_25 = SplitTree(Data=split_tree_23.Positive, Masks=flatten("{0;0}"))  # -> Positive, Negative
split_tree_26 = SplitTree(Data=partition_list_6, Masks=flatten("{0;0}"))  # -> Positive, Negative
split_tree_27 = SplitTree(Data=partition_list_7, Masks=flatten("{0;0}"))  # -> Positive, Negative
split_tree_28 = SplitTree(Data=split_tree_24.Positive, Masks=flatten("{0;0}"))  # -> Positive, Negative
# 3-5-C. Tendon Prestress
tendon_prestress = TendonPrestress(
    TendonProfileID=split_tree_26.Positive,
    LoadGroupName=split_tree_25.Positive,
    LoadCaseName="PS",
    JakingForceAtBegin=value_kn_m²_9,
    JakingForceAtEnd=value_kn_m²_10,
    GroutingStage=stage,
    prevData_itemkey=[8, 9, 27, 28],
    prevData_key=[0, 1, 2, 3],
    prevData_subid0=[1, 1, 2, 1])
tendon_prestress_2 = TendonPrestress(
    TendonProfileID=split_tree_26.Negative,
    LoadGroupName=split_tree_25.Negative,
    LoadCaseName="PS",
    JakingForceAtBegin=value_kn_m²_5,
    JakingForceAtEnd=value_kn_m²_5,
    GroutingStage=stage_4,
    prevData_itemkey=[7, 26, 6, 25, 5, 24, 4, 23, 3, 22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],
    prevData_key=[0, 1, 2, 3, 4, 5, 6, 7, 8, 9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],
    prevData_subid0=[1, 2, 1, 2, 1, 1, 2, 1, 1, 1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])
tendon_prestress_3 = TendonPrestress(
    TendonProfileID=split_tree_27.Positive,
    LoadGroupName=split_tree_28.Positive,
    LoadCaseName="PS",
    JakingForceAtBegin=value_kn_m²_11,
    JakingForceAtEnd=value_kn_m²_12,
    GroutingStage=stage_6,
    prevData_itemkey=[49, 50, 71, 72],
    prevData_key=[0, 1, 2, 3],
    prevData_subid0=[2, 1, 2, 1])
tendon_prestress_4 = TendonPrestress(
    TendonProfileID=split_tree_27.Negative,
    LoadGroupName=split_tree_28.Negative,
    LoadCaseName="PS",
    JakingForceAtBegin=value_kn_m²_8,
    JakingForceAtEnd=value_kn_m²_8,
    GroutingStage=stage_7,
    prevData_itemkey=[48, 70, 47, 69, 46, 68, 45, 67, 41, 44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],
    prevData_key=[0, 1, 2, 3, 4, 5, 6, 7, 8, 9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],
    prevData_subid0=[2, 1, 2, 1, 2, 2, 1, 2, 2, 2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])

cluster_79 = Cluster_20(list=curve_16, text=cluster_58.x_component, text_2=cluster_58.result)  # -> i, vertices
cluster_80 = Cluster_21(text=cluster_58.x_component, curve=curve_16, d2=shift_paths_29, A=data_26)
shift_paths_39 = ShiftPaths(Data=cluster_80, Offset=-1)
deconstruct_4 = Deconstruct(Point=shift_paths_39)  # -> XComponent, YComponent, ZComponent
evaluate_length_21 = EvaluateLength(Curve=curve_17, Length=deconstruct_4.XComponent, Normalized=False)  # -> Point, Tangent, Parameter
tree_statistics_27 = TreeStatistics(Tree=cluster_80)  # -> Paths, Length, Count

# ---- group: Make Tendon Name
cluster_81 = Cluster_12(fragment_a="FSM1", fragment_b="B", tree=simplify(cluster_79.vertices))  # -> data, paths

# ---- group: Find the point location that Tendon should refer to
cluster_82 = Cluster_11(curve=cluster_34.geometry_3, A=deconstruct_4.XComponent)

# ---- group: Move to Point
vector_2pt_3 = Vector2Pt(PointA=cluster_82, PointB=evaluate_length_21.Point, Unitize=False)  # -> Vector, Length
move_7 = Move(Geometry=shift_paths_39, Motion=vector_2pt_3.Vector)  # -> Geometry, Transform

# ----
cluster_83 = Cluster_16(tree=cluster_82, tree_2=move_7.Geometry, curve=curve, tree_3=deconstruct_4.XComponent)
partition_list_8 = PartitionList(List=cluster_83, Size=tree_statistics_27.Length)

# ---- group: Path Matching
tree_statistics_28 = TreeStatistics(Tree=partition_list_8)  # -> Paths, Length, Count
tree_statistics_29 = TreeStatistics(Tree=cluster_79.vertices)  # -> Paths, Length, Count
replace_paths_7 = ReplacePaths(Data=partition_list_8, Search=tree_statistics_28.Paths, Replace=tree_statistics_29.Paths)  # -> simplify(Data)

# ---- group: Tendon Element ID
list_item_43 = ListItem(List=replace_paths_7, Index=1, Wrap=True)  # -> flatten(Item)
closest_point_3 = ClosestPoint(Point=list_item_43, Cloud=sort_points_11.Points)  # -> ClosestPoint, CPIndex, Distance
list_length_20 = ListLength(List=replace_paths_7)
series_11 = Series(Start=graft(closest_point_3.CPIndex), Step=1, Count=expr("x-1", list_length_20))  # -> simplify(Series)
list_item_44 = ListItem(List=list_item_32, Index=expr("x-1", series_11), Wrap=True)
tree_statistics_30 = TreeStatistics(Tree=list_item_44)  # -> Paths, Length, Count
replace_paths_8 = ReplacePaths(Data=list_item_44, Search=tree_statistics_30.Paths, Replace=tree_statistics_29.Paths)  # -> simplify(Data)

# ----
point_3 = Point(replace_paths_7)
tendon_profile_item_3 = TendonProfileItem(
    XyOrXyzCoordinate=point_3,
    prevData_itemkey=[0, 0, 0, 0, 0, 0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],
    prevData_key=[0, 1, 2, 3, 4, 5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])
text_11 = Text(cluster_81.data)
cluster_84 = Cluster_13(start=cluster_78, tree=text_11)
cluster_85 = Cluster_14(number=cluster_84)
number_16 = Number(replace_paths_8)
# Left Side Bot Tendon
_3d_spline_tendon_profile_3 = _3DSplineTendonProfile(
    TendonProfileID=cluster_84,
    TendonName=text_11,
    TendonPropertyID=number_6,
    AssignedElementsID=number_16,
    StraightLengthOfTendonBegin=number_slider_16,
    StraightLengthOfTendonEnd=number_slider_16,
    TransferLengthBegin=number_slider_16,
    TransferLengthEnd=number_slider_16,
    DebondedLengthBegin=number_slider_16,
    DebondedLengthEnd=number_slider_16,
    TendonProfileXyzInputType3D=tendon_profile_item_3,
    prevData_itemkey=[83, 84, 85, 86, 87, 88, 89, 90, 91, 92, 93, 94, 95, 96],
    prevData_key=[0, 1, 2, 3, 4, 5, 6, 7, 8, 9, 10, 11, 12, 13])
get_property_36 = GetProperty(DATA=_3d_spline_tendon_profile_3)  # -> Command, ID, NAME, TDN_PROP, ELEM, BTP, INPUT, CURVE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
tendon_prestress_5 = TendonPrestress(
    TendonProfileID=get_property_36.ID,
    LoadGroupName=explode_tree_19.Branch0,
    LoadCaseName="PS",
    JakingForceAtBegin=value_kn_m²,
    JakingForceAtEnd=value_kn_m²_2,
    GroutingStage=stage_2,
    prevData_itemkey=[83, 84, 85, 86, 87, 88, 89, 90, 91, 92, 93, 94, 95, 96],
    prevData_key=[0, 1, 2, 3, 4, 5, 6, 7, 8, 9, 10, 11, 12, 13],
    prevData_subid0=[1, 2, 1, 2, 2, 1, 2, 1, 2, 1, 2, 1, 1, 2])

cluster_86 = Cluster_20(list=curve_20, text=cluster_64.x_component, text_2=cluster_64.result)  # -> i, vertices
cluster_87 = Cluster_21(text=cluster_64.x_component, curve=curve_20, d2=shift_paths_31, A=data_28)
shift_paths_40 = ShiftPaths(Data=cluster_87, Offset=-1)
deconstruct_5 = Deconstruct(Point=shift_paths_40)  # -> XComponent, YComponent, ZComponent
division_7 = Division(A=deconstruct_5.XComponent, B=cluster_63.result)
evaluate_length_22 = EvaluateLength(Curve=curve_21, Length=division_7, Normalized=False)  # -> Point, Tangent, Parameter
tree_statistics_31 = TreeStatistics(Tree=cluster_87)  # -> Paths, Length, Count

# ---- group: Make Tendon Name
cluster_88 = Cluster_12(fragment_a="FSM2", fragment_b="B", tree=simplify(cluster_86.vertices))  # -> data, paths

# ---- group: Find the point location that Tendon should refer to
cluster_89 = Cluster_11(curve=cluster_36.geometry_3, A=deconstruct_5.XComponent)

# ---- group: Move to Point
vector_2pt_4 = Vector2Pt(PointA=cluster_89, PointB=evaluate_length_22.Point, Unitize=False)  # -> Vector, Length
move_8 = Move(Geometry=shift_paths_40, Motion=vector_2pt_4.Vector)  # -> Geometry, Transform

# ----
cluster_90 = Cluster_16(tree=cluster_89, tree_2=move_8.Geometry, curve=curve, tree_3=division_7)
partition_list_9 = PartitionList(List=cluster_90, Size=tree_statistics_31.Length)

# ---- group: Path Matching
tree_statistics_32 = TreeStatistics(Tree=partition_list_9)  # -> Paths, Length, Count
tree_statistics_33 = TreeStatistics(Tree=cluster_86.vertices)  # -> Paths, Length, Count
replace_paths_9 = ReplacePaths(Data=partition_list_9, Search=tree_statistics_32.Paths, Replace=tree_statistics_33.Paths)  # -> simplify(Data)

# ---- group: Tendon Element ID
list_item_45 = ListItem(List=replace_paths_9, Index=1, Wrap=True)  # -> flatten(Item)
closest_point_4 = ClosestPoint(Point=list_item_45, Cloud=sort_points_11.Points)  # -> ClosestPoint, CPIndex, Distance
list_length_21 = ListLength(List=replace_paths_9)
series_12 = Series(Start=graft(closest_point_4.CPIndex), Step=1, Count=expr("x-1", list_length_21))  # -> simplify(Series)
list_item_46 = ListItem(List=list_item_32, Index=expr("x-1", series_12), Wrap=True)
tree_statistics_34 = TreeStatistics(Tree=list_item_46)  # -> Paths, Length, Count
replace_paths_10 = ReplacePaths(Data=list_item_46, Search=tree_statistics_34.Paths, Replace=tree_statistics_33.Paths)  # -> simplify(Data)

# ----
point_4 = Point(replace_paths_9)
tendon_profile_item_4 = TendonProfileItem(
    XyOrXyzCoordinate=point_4,
    prevData_itemkey=[0, 0, 0, 0, 0, 0, 0, 0, 0, 0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],
    prevData_key=[0, 1, 2, 3, 4, 5, 6, 7, 8, 9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])
text_12 = Text(cluster_88.data)
number_17 = Number(replace_paths_10)

cluster_91 = Cluster_21(text=cluster_61.x_component, curve=curve_18, d2=shift_paths_30, A=data_27)
cluster_92 = Cluster_20(list=curve_18, text=cluster_61.x_component, text_2=cluster_61.result)  # -> i, vertices
shift_paths_41 = ShiftPaths(Data=cluster_91, Offset=-1)
deconstruct_6 = Deconstruct(Point=shift_paths_41)  # -> XComponent, YComponent, ZComponent
evaluate_length_23 = EvaluateLength(Curve=curve_19, Length=deconstruct_6.XComponent, Normalized=False)  # -> Point, Tangent, Parameter
tree_statistics_35 = TreeStatistics(Tree=cluster_91)  # -> Paths, Length, Count

# ---- group: Make Tendon Name
cluster_93 = Cluster_12(fragment_a="CENT", fragment_b="B", tree=cluster_92.vertices)  # -> data, paths

# ---- group: Find the point location that Tendon should refer to
cluster_94 = Cluster_11(curve=cluster_33.geometry_3, A=deconstruct_6.XComponent)

# ---- group: Move to Point
vector_2pt_5 = Vector2Pt(PointA=cluster_94, PointB=evaluate_length_23.Point, Unitize=False)  # -> Vector, Length
move_9 = Move(Geometry=shift_paths_41, Motion=vector_2pt_5.Vector)  # -> Geometry, Transform

# ----
cluster_95 = Cluster_16(tree=cluster_94, tree_2=move_9.Geometry, curve=curve, tree_3=deconstruct_6.XComponent)
partition_list_10 = PartitionList(List=cluster_95, Size=tree_statistics_35.Length)

# ---- group: Path Matching
tree_statistics_36 = TreeStatistics(Tree=partition_list_10)  # -> Paths, Length, Count
tree_statistics_37 = TreeStatistics(Tree=cluster_92.vertices)  # -> Paths, Length, Count
replace_paths_11 = ReplacePaths(Data=partition_list_10, Search=tree_statistics_36.Paths, Replace=tree_statistics_37.Paths)  # -> simplify(Data)

# ---- group: Tendon Element ID
list_item_47 = ListItem(List=replace_paths_11, Index=1, Wrap=True)  # -> flatten(Item)
closest_point_5 = ClosestPoint(Point=list_item_47, Cloud=sort_points_11.Points)  # -> ClosestPoint, CPIndex, Distance
list_length_22 = ListLength(List=replace_paths_11)
series_13 = Series(Start=graft(closest_point_5.CPIndex), Step=1, Count=expr("x-1", list_length_22))  # -> simplify(Series)
list_item_48 = ListItem(List=list_item_32, Index=expr("x-1", series_13), Wrap=True)
tree_statistics_38 = TreeStatistics(Tree=list_item_48)  # -> Paths, Length, Count
replace_paths_12 = ReplacePaths(Data=list_item_48, Search=tree_statistics_38.Paths, Replace=tree_statistics_37.Paths)  # -> simplify(Data)

# ----
point_5 = Point(replace_paths_11)
tendon_profile_item_5 = TendonProfileItem(
    XyOrXyzCoordinate=point_5,
    prevData_itemkey=[0, 0, 0, 0, 0, 0, 0, 0, 0, 0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],
    prevData_key=[0, 1, 2, 3, 4, 5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])
text_13 = Text(cluster_93.data)
cluster_96 = Cluster_13(start=cluster_85, tree=text_13)
cluster_97 = Cluster_14(number=cluster_96)
number_18 = Number(replace_paths_12)
cluster_98 = Cluster_13(start=cluster_97, tree=text_12)
# Center Bot Tendon
_3d_spline_tendon_profile_4 = _3DSplineTendonProfile(
    TendonProfileID=cluster_96,
    TendonName=text_13,
    TendonPropertyID=number_5,
    AssignedElementsID=number_18,
    StraightLengthOfTendonBegin=number_slider_15,
    StraightLengthOfTendonEnd=number_slider_15,
    TransferLengthBegin=number_slider_15,
    TransferLengthEnd=number_slider_15,
    DebondedLengthBegin=number_slider_15,
    DebondedLengthEnd=number_slider_15,
    TendonProfileXyzInputType3D=tendon_profile_item_5,
    prevData_itemkey=[97, 98, 99, 100, 101, 102, 103, 104, 105, 106, 107, 108, 109, 110, 111, 112, 113, 114],
    prevData_key=[0, 1, 2, 3, 4, 5, 6, 7, 8, 9, 10, 11, 12, 13, 14, 15, 16, 17])
# Right Side Bot Tendon
_3d_spline_tendon_profile_5 = _3DSplineTendonProfile(
    TendonProfileID=cluster_98,
    TendonName=text_12,
    TendonPropertyID=number_8,
    AssignedElementsID=number_17,
    StraightLengthOfTendonBegin=number_slider_17,
    StraightLengthOfTendonEnd=number_slider_17,
    TransferLengthBegin=number_slider_17,
    TransferLengthEnd=number_slider_17,
    DebondedLengthBegin=number_slider_17,
    DebondedLengthEnd=number_slider_17,
    TendonProfileXyzInputType3D=tendon_profile_item_4,
    prevData_itemkey=[115, 116, 117, 118, 119, 120, 121, 122, 123, 124, 125, 126, 127, 128],
    prevData_key=[0, 1, 2, 3, 4, 5, 6, 7, 8, 9, 10, 11, 12, 13])
get_property_37 = GetProperty(DATA=_3d_spline_tendon_profile_4)  # -> Command, ID, NAME, TDN_PROP, ELEM, BTP, INPUT, CURVE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
get_property_38 = GetProperty(DATA=_3d_spline_tendon_profile_5)  # -> Command, ID, NAME, TDN_PROP, ELEM, BTP, INPUT, CURVE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
tendon_prestress_6 = TendonPrestress(
    TendonProfileID=get_property_37.ID,
    LoadGroupName=explode_tree_19.Branch2,
    LoadCaseName="PS",
    JakingForceAtBegin=value_kn_m²_3,
    JakingForceAtEnd=value_kn_m²_4,
    GroutingStage=stage_3,
    prevData_itemkey=[97, 98, 99, 100, 101, 102, 103, 104, 105, 106, 107, 108, 109, 110, 111, 112, 113, 114],
    prevData_key=[0, 1, 2, 3, 4, 5, 6, 7, 8, 9, 10, 11, 12, 13, 14, 15, 16, 17],
    prevData_subid0=[2, 1, 2, 1, 1, 2, 1, 2, 1, 2, 1, 2, 2, 1, 2, 1, 2, 1])
tendon_prestress_7 = TendonPrestress(
    TendonProfileID=get_property_38.ID,
    LoadGroupName=explode_tree_19.Branch1,
    LoadCaseName="PS",
    JakingForceAtBegin=value_kn_m²_6,
    JakingForceAtEnd=value_kn_m²_7,
    GroutingStage=stage_5,
    prevData_itemkey=[115, 116, 117, 118, 119, 120, 121, 122, 123, 124, 125, 126, 127, 128],
    prevData_key=[0, 1, 2, 3, 4, 5, 6, 7, 8, 9, 10, 11, 12, 13],
    prevData_subid0=[1, 2, 1, 2, 2, 1, 2, 1, 2, 1, 2, 1, 1, 2])

multiplication_8 = Multiplication(A=p_kn, B=e_m, C=path_mapper_4)
deconstruct_vector_3 = DeconstructVector(Vector=multiplication_8)  # -> XComponent, YComponent, ZComponent
shift_paths_42 = ShiftPaths(Data=multiplication_6, Offset=-1)
shift_paths_43 = ShiftPaths(Data=deconstruct_vector_3.XComponent, Offset=-1)
shift_paths_44 = ShiftPaths(Data=deconstruct_vector_3.YComponent, Offset=-1)
shift_paths_45 = ShiftPaths(Data=deconstruct_vector_2.XComponent, Offset=-1)
shift_paths_46 = ShiftPaths(Data=deconstruct_vector_2.YComponent, Offset=-1)
tree_statistics_39 = TreeStatistics(Tree=shift_paths_43)  # -> Paths, Length, Count
negative_4 = Negative(Value=shift_paths_42)
tree_statistics_40 = TreeStatistics(Tree=shift_paths_45)  # -> Paths, Length, Count
dispatch_2 = Dispatch(List=tree_statistics_39.Paths, DispatchPattern=[True, False])  # -> ListA, ListB
dispatch_3 = Dispatch(List=tree_statistics_40.Paths, DispatchPattern=[True, False])  # -> ListA, ListB
data_30 = Data(explode_tree_17.Branch2)
flatten_tree_10 = FlattenTree(Tree=explode_tree_17.Branch1, Path="{0}")
flatten_tree_11 = FlattenTree(Tree=data_30, Path="{0}")
data_31 = Data(explode_tree_17.Branch0)
text_14 = Text(split_list_7.ListA)
number_19 = Number(negative_4)
text_15 = Text(split_list_4.ListA)
beam_loads = BeamLoads(
    ElementID=merge_28,
    LoadGroupName=flatten_tree_10,
    LoadCaseName=flatten_tree_7,
    LoadV1=expr("-x", number_10),
    LoadV2=expr("-x", number_10),
    prevData_itemkey=[1, 2, 3, 4, 5, 6, 7, 8, 92, 91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],
    prevData_key=[0, 1, 2, 3, 4, 5, 6, 7, 73, 72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],
    prevData_subid0=[1, 1, 1, 1, 1, 1, 1, 1, 1, 1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])
time_loads_for_cs = TimeLoadsForCS(
    ElementID=flatten_tree_8,
    LoadGroupName=flatten_tree_11,
    TimeLoads=data_15,
    prevData_itemkey=[1, 115, 114, 113, 73, 72, 71, 70, 69, 68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],
    prevData_key=[0, 59, 58, 57, 56, 55, 54, 53, 52, 51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],
    prevData_subid0=[1, 2, 2, 2, 1, 1, 1, 1, 1, 1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])
self_weight = SelfWeight(
    SelfWeightID=Slider(1, range=0..1),
    LoadCaseName=text_2,
    LoadGroupName=data_31,
    Z=number_11,
    prevData_itemkey=1,
    prevData_key=0)

# ---- group: Moment Y
split_tree_29 = SplitTree(Data=shift_paths_43, Masks=flatten(dispatch_2.ListA))  # -> Positive, Negative
negative_5 = Negative(Value=split_tree_29.Positive)
merge_39 = Merge(Data1=negative_5, Data2=split_tree_29.Negative)

# ---- group: Moment X
split_tree_30 = SplitTree(Data=shift_paths_44, Masks=flatten(dispatch_2.ListA))  # -> Positive, Negative
negative_6 = Negative(Value=split_tree_30.Positive)
merge_40 = Merge(Data1=negative_6, Data2=split_tree_30.Negative)

# ---- group: Moment Y
split_tree_31 = SplitTree(Data=shift_paths_45, Masks=flatten(dispatch_3.ListA))  # -> Positive, Negative
negative_7 = Negative(Value=split_tree_31.Positive)
merge_41 = Merge(Data1=negative_7, Data2=split_tree_31.Negative)

# ---- group: Moment X
split_tree_32 = SplitTree(Data=shift_paths_46, Masks=flatten(dispatch_3.ListA))  # -> Positive, Negative
negative_8 = Negative(Value=split_tree_32.Positive)
merge_42 = Merge(Data1=negative_8, Data2=split_tree_32.Negative)

# ----
number_20 = Number(merge_40)
number_21 = Number(merge_39)
number_22 = Number(merge_42)
number_23 = Number(merge_41)
nodal_loads = NodalLoads(
    NodeID=integer_6,
    LoadGroupName=text_14,
    LoadCaseName=text_3,
    FZ=negative_3,
    MX=number_20,
    MY=number_21,
    prevData_itemkey=[4, 182, 183, 184, 185, 186, 187, 188, 189, 190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],
    prevData_key=[0, 1, 2, 3, 4, 5, 6, 7, 8, 9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],
    prevData_subid0=[1, 1, 1, 1, 1, 1, 1, 1, 1, 1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])
nodal_loads_2 = NodalLoads(
    NodeID=number_12,
    LoadGroupName=text_15,
    LoadCaseName=text_4,
    FZ=number_19,
    MX=number_22,
    MY=number_23,
    prevData_itemkey=[4, 182, 183, 184, 185, 186, 187, 188, 189, 190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],
    prevData_key=[0, 1, 2, 3, 4, 5, 6, 7, 8, 9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],
    prevData_subid0=[2, 2, 2, 2, 2, 2, 2, 2, 2, 2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])

midas_merge_data_3 = MidasMergeData(DATA1=static_load_cases, DATA2=self_weight, DATA3=post_tension_tendon_property, DATA4=post_tension_tendon_property_2)  # -> STLD, BODF, TDNT
midas_merge_data_4 = MidasMergeData(
    DATA1=supports,
    DATA2=supports_2,
    DATA3=rigid_elastic_link,
    DATA4=time_loads_for_cs,
    DATA5=beam_loads,
    DATA6=nodal_loads_2,
    DATA7=nodal_loads,
    DATA8=_3d_spline_tendon_profile,
    DATA9=_3d_spline_tendon_profile_2,
    DATA10=_3d_spline_tendon_profile_3,
    DATA11=_3d_spline_tendon_profile_4,
    DATA12=_3d_spline_tendon_profile_5,
    DATA13=tendon_prestress,
    DATA14=tendon_prestress_2,
    DATA15=tendon_prestress_3,
    DATA16=tendon_prestress_4,
    DATA17=tendon_prestress_5,
    DATA18=tendon_prestress_6,
    DATA19=tendon_prestress_7)  # -> CONS, ELNK, TMLD, BMLD, CNLD, TDNA, TDPL
midas_model_builder_3 = MidasModelBuilder(
    DATA1=midas_merge_data_4.CONS,
    DATA2=midas_merge_data_4.ELNK,
    DATA3=midas_merge_data_4.TMLD,
    DATA4=midas_merge_data_4.BMLD,
    DATA5=midas_merge_data_4.CNLD,
    DATA6=midas_merge_data_4.TDNA,
    DATA7=midas_merge_data_4.TDPL)
midas_model_builder_4 = MidasModelBuilder(DATA1=midas_merge_data_3.STLD, DATA2=midas_merge_data_3.BODF, DATA3=midas_merge_data_3.TDNT)

# ----
# C.S Load Group
# Wet Con'c
# Segment
# Active
# Deactive
# KeySeg
# Active
# Deactive
# Active
# Form Traveller
# PierTable
# Active
# Deactive
# Deactive
# Segment
# Active
# Deactive
# Prestress
# PierTable
# Active
# Segment
# Active
# ETC
# Self
# Active
# 2nd Load
# Active
# Time Load
# Active
number_slider_25 = Slider(1, range=0..1)
# 3-6-D. Deactive Step Interval
deactive_step_interval = Slider(1, range=0..1)
data_32 = Data(concatenate)
series_14 = Series(Start=segment_construction_step, Step=expr("2", 1), Count=tree_statistics_12.Count)
split_list_8 = SplitList(List=series_14, Index=Slider(1, range=0..1))  # -> ListA, ListB
split_list_9 = SplitList(List=split_list_8.ListB, Index=number_slider_25)  # -> ListA, ListB
list_item_49 = ListItem(List=series_14, Index=0, Wrap=True)
deactive_step_interval_2 = Slider(1, range=0..1)
list_item_50 = ListItem(List=data_32, Index=expr("x+1", list_item_49), Wrap=True)  # -> simplify(graft(Item))
merge_43 = Merge(Data1=graft_tree_14, Data2=graft_tree_17)
merge_44 = Merge(Data1=graft_tree_16, Data2=graft_tree_19)
merge_45 = Merge(Data1=graft_tree_15, Data2=graft_tree_18)
data_33 = Data(data_32)
data_34 = Data(graft(explode_tree_18.Branch1))
data_35 = Data(explode_tree_14.Branch1)
data_36 = Data(data_32)
data_37 = Data(merge_45)
data_38 = Data(data_32)
data_39 = Data(data_32)
data_40 = Data(list_item_25)
data_41 = Data(merge_43)
panel_26 = Panel(list_item_50)
data_42 = Data(data_40)
data_43 = Data(explode_tree_14.Branch0)
data_44 = Data(data_32)
data_45 = Data(data_32)
data_46 = Data(merge_44)
data_47 = Data(data_40)
data_48 = Data(data_32)
data_49 = Data(explode_tree_17.Branch0)
data_50 = Data(data_32)
list_item_51 = ListItem(List=data_50, Index=-1, Wrap=True)
data_51 = Data(explode_tree_17.Branch1)
data_52 = Data(data_32)
data_53 = Data(explode_tree_17.Branch2)
duplicate_data_7 = DuplicateData(Data=_1_segment_date_2, Number=segment_construction_step, Order=True)  # -> flatten(Data)
tree_statistics_41 = TreeStatistics(Tree=graft(duplicate_data_7))  # -> Paths, Length, Count

shift_paths_47 = ShiftPaths(Data=split_list_9.ListA, Offset=-1)
# Keyseg
data_54 = Data(data_32)

# ----
# C.S Structure Group
# Pier
# PierTable
# FSM
# Segment
# KeySeg
# Define C.S
data_55 = Data(concatenate)
series_15 = Series(Start=expr("x+1", segment_construction_step), Step=1, Count=tree_statistics_12.Count)
split_list_10 = SplitList(List=series_15, Index=Slider(1, range=0..1))  # -> ListA, reverse(ListB)
series_16 = Series(Start=expr("x+1", segment_construction_step), Step=2, Count=tree_statistics_13.Count)
merge_46 = Merge(Data1=get_property_21.NAME, Data2=get_property_22.NAME)
data_56 = Data(tree_statistics_12.Count)
number_slider_26 = Slider(1, range=0..1)
# 3-6-C. Start CS Step
number_slider_27 = Slider(1, range=0..1)
duplicate_data_8 = DuplicateData(Data=_1_segment_date, Number=segment_construction_step, Order=True)  # -> flatten(Data)
duplicate_data_9 = DuplicateData(Data=key_segment_date, Number=data_56, Order=True)  # -> flatten(Data)
merge_47 = Merge(Data1=split_list_10.ListA, Data2=split_list_10.ListB)
list_item_52 = ListItem(List=data_55, Index=merge_47, Wrap=True)  # -> simplify(graft(Item))
list_item_53 = ListItem(List=data_55, Index=series_16, Wrap=True)  # -> simplify(graft(Item))
data_57 = Data(get_property_19.NAME)
data_58 = Data(merge_46)
data_59 = Data(list_item_25)
data_60 = Data(data_55)
data_61 = Data(data_55)
data_62 = Data(data_55)
data_63 = Data(flatten_tree_5)
data_64 = Data(data_55)
data_65 = Data(flatten_tree_6)
data_66 = Data(get_property_20.NAME)
data_67 = Data(data_55)
cluster_99 = Cluster_3(data_3=data_61, member=list_item_52, data=data_57, count=number_slider_26)
cluster_100 = Cluster_3(data_3=data_62, member="CS1", data=data_63, count=number_slider_27)
cluster_101 = Cluster_3(data_3=data_64, member="CS1", data=data_65, count=Slider(1, range=0..1))
cluster_102 = Cluster_3(data_3=data_67, member=list_item_53, data=data_66, count=Slider(1, range=0..1))
cluster_103 = Cluster_3(data_3=data_60, member="CS2", data=data_58, count=data_59)
tree_statistics_42 = TreeStatistics(Tree=graft(duplicate_data_8))  # -> Paths, Length, Count
tree_statistics_43 = TreeStatistics(Tree=cluster_103)  # -> Paths, Length, Count
tree_statistics_44 = TreeStatistics(Tree=graft(duplicate_data_9))  # -> Paths, Length, Count
tree_statistics_45 = TreeStatistics(Tree=cluster_99)  # -> Paths, Length, Count
replace_paths_13 = ReplacePaths(Data=graft(duplicate_data_8), Search=tree_statistics_42.Paths, Replace=tree_statistics_43.Paths)
replace_paths_14 = ReplacePaths(Data=graft(duplicate_data_9), Search=tree_statistics_44.Paths, Replace=tree_statistics_45.Paths)
# 3-6 Construction Stage
data_68 = Data(cluster_100)
data_69 = Data(cluster_101)
data_70 = Data(cluster_102)
data_71 = Data(cluster_103)
data_72 = Data(cluster_99)
c_s_act_structure_group = CSActStructureGroup(
    ActivatedStructureGroupName=data_68,
    AgeDays=pier_date,
    prevData_itemkey=[0, 0, 0, 0, 0, 0, 0, 0, 0, 0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],
    prevData_key=[0, 1, 2, 3, 4, 5, 6, 7, 8, 9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])
c_s_act_structure_group_2 = CSActStructureGroup(ActivatedStructureGroupName=data_69, AgeDays=piertable_date, prevData_itemkey=[0, 0], prevData_key=[0, 1])
c_s_act_structure_group_3 = CSActStructureGroup(ActivatedStructureGroupName=data_70, AgeDays=fsm_date, prevData_itemkey=[0, 0, 0], prevData_key=[0, 1, 2])
c_s_act_structure_group_4 = CSActStructureGroup(
    ActivatedStructureGroupName=data_71,
    AgeDays=replace_paths_13,
    prevData_itemkey=[0, 0, 0, 0, 0, 0, 0, 0, 0, 0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],
    prevData_key=[0, 1, 2, 3, 4, 5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])
c_s_act_structure_group_5 = CSActStructureGroup(
    ActivatedStructureGroupName=data_72,
    AgeDays=replace_paths_14,
    prevData_itemkey=[0, 0, 0, 0, 0, 0, 0, 0, 0, 0, 0, 0, 0, 0, 0, 0, 0, 0],
    prevData_key=[0, 1, 2, 3, 4, 5, 6, 7, 8, 9, 10, 11, 12, 13, 14, 15, 16, 17])
merge_48 = Merge(
    Data1=c_s_act_structure_group,
    Data2=c_s_act_structure_group_2,
    Data3=c_s_act_structure_group_3,
    Data4=c_s_act_structure_group_4,
    Data5=c_s_act_structure_group_5)
data_73 = Data(merge_48)
cluster_104 = Cluster_4(tree=merge_21)
cluster_105 = Cluster_4(tree=merge_22)
graft_tree_20 = GraftTree(Tree=concatenate, IncludeEmptyLists=True, IncludeNullItems=True)
flatten_tree_12 = FlattenTree(Tree=graft_tree_20, Path="{0}")
list_length_23 = ListLength(List=flatten_tree_12)
series_17 = Series(Start=1, Step=1, Count=list_length_23)  # -> graft(Series)
cluster_106 = Cluster_6(d1=data_73, list=graft_tree_20)

# ----
# C.S Boundary Group
# Pier
# Active
# FSM
number_slider_28 = Slider(1, range=0..1)
data_74 = Data(data_32)
data_75 = Data("CS1")
data_76 = Data(flatten_tree_9)
data_77 = Data(number_slider_27)
data_78 = Data(data_32)
data_79 = Data(list_item_53)
data_80 = Data(get_property_27.NAME)
data_81 = Data(number_slider_27)
cluster_107 = Cluster_5(data_3=data_74, member=data_75, data=data_76, count=data_77, B=number_slider_28)  # -> data_6, data_5
cluster_108 = Cluster_5(data_3=data_78, member=data_79, data=data_80, count=data_81, B=Slider(1, range=0..1))  # -> data_6, data_5
c_s_act_boundary_group = CSActBoundaryGroup(ActivatedBoundaryGroupName=cluster_108.data_6, prevData_itemkey=[0, 0, 0], prevData_key=[0, 1, 2])
c_s_act_boundary_group_2 = CSActBoundaryGroup(ActivatedBoundaryGroupName=cluster_107.data_6, prevData_itemkey=[0, 0], prevData_key=[0, 1])
merge_49 = Merge(Data1=c_s_act_boundary_group_2, Data2=c_s_act_boundary_group)

data_82 = Data(list_item_52)
data_83 = Data(number_slider_26)
cluster_109 = Cluster_5(data_3=data_54, member=data_82, data=data_29, count=data_83, B=Slider(1, range=0..1))  # -> data_6, data_5
# Active
c_s_act_load_group = CSActLoadGroup(
    ActivatedLoadGroupName=cluster_109.data_6,
    prevData_itemkey=[0, 0, 0, 0, 0, 0, 0, 0, 0, 0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],
    prevData_key=[0, 1, 2, 3, 4, 5, 6, 7, 8, 9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])

merge_50 = Merge(Data1=split_list_8.ListA, Data2=shift_paths_47, Data3=split_list_8.ListA)
list_item_54 = ListItem(List=data_32, Index=merge_50, Wrap=True)  # -> simplify(graft(Item))
data_84 = Data("CS1")
data_85 = Data(number_slider_27)
data_86 = Data("CS1")
data_87 = Data("CS2")
data_88 = Data(number_slider_27)
data_89 = Data("CS1")
data_90 = Data("CS2")
data_91 = Data(number_slider_27)
data_92 = Data(number_slider_27)
data_93 = Data(number_slider_27)
cluster_110 = Cluster_5(data_3=data_33, member=data_84, data=data_35, count=data_85, B=Slider(1, range=0..1))  # -> data_6, data_5
cluster_111 = Cluster_5(data_3=data_38, member=data_87, data=data_41, count=data_42, B=Slider(1, range=0..1))  # -> data_6, data_5
cluster_112 = Cluster_5(data_3=data_39, member=data_89, data=data_43, count=data_88, B=Slider(1, range=0..1))  # -> data_6, data_5
cluster_113 = Cluster_5(data_3=data_36, member=data_86, data=data_37, count=data_40, B=deactive_step_interval)  # -> data_6, data_5
cluster_114 = Cluster_5(data_3=data_48, member="CS1", data=data_49, count=data_91, B=Slider(1, range=0..1))  # -> data_6, data_5
cluster_115 = Cluster_5(data_3=data_45, member=data_90, data=data_46, count=data_47, B=Slider(1, range=0..1))  # -> data_6, data_5
cluster_116 = Cluster_5(data_3=data_50, member=list_item_51, data=data_51, count=data_92, B=Slider(1, range=0..1))  # -> data_6, data_5
cluster_117 = Cluster_5(data_3=data_52, member=panel_26, data=data_53, count=data_93, B=Slider(1, range=0..1))  # -> data_6, data_5
cluster_118 = Cluster_5(data_3=data_44, member=list_item_54, data=data_34, count=Slider(1, range=0..1), B=deactive_step_interval_2)  # -> data_6, data_5
tree_statistics_46 = TreeStatistics(Tree=cluster_113.data_5)  # -> Paths, Length, Count
tree_statistics_47 = TreeStatistics(Tree=cluster_118.data_5)  # -> Paths, Length, Count
duplicate_data_10 = DuplicateData(Data=key_segment_date_2, Number=tree_statistics_47.Count, Order=True)  # -> flatten(Data)
tree_statistics_48 = TreeStatistics(Tree=graft(duplicate_data_10))  # -> Paths, Length, Count
tree_statistics_49 = TreeStatistics(Tree=cluster_118.data_5)  # -> Paths, Length, Count
replace_paths_15 = ReplacePaths(Data=graft(duplicate_data_7), Search=tree_statistics_41.Paths, Replace=tree_statistics_46.Paths)
replace_paths_16 = ReplacePaths(Data=graft(duplicate_data_10), Search=tree_statistics_48.Paths, Replace=tree_statistics_49.Paths)
c_s_deact_load_group = CSDeactLoadGroup(
    DeactivatedLoadGroupName=cluster_113.data_5,
    prevData_itemkey=[0, 0, 0, 0, 0, 0, 0, 0, 0, 0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],
    prevData_key=[0, 1, 2, 3, 4, 5, 6, 7, 8, 9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])
c_s_deact_load_group_2 = CSDeactLoadGroup(DeactivatedLoadGroupName=cluster_110.data_5, prevData_itemkey=[0, 0, 0, 0], prevData_key=[0, 1, 2, 3])
c_s_act_load_group_2 = CSActLoadGroup(ActivatedLoadGroupName=cluster_110.data_6, prevData_itemkey=[0, 0, 0, 0], prevData_key=[0, 1, 2, 3])
c_s_deact_load_group_3 = CSDeactLoadGroup(
    DeactivatedLoadGroupName=cluster_118.data_5,
    prevData_itemkey=[0, 0, 0, 0, 0, 0, 0, 0, 0, 0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],
    prevData_key=[0, 1, 2, 3, 4, 5, 6, 7, 8, 9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])
c_s_act_load_group_3 = CSActLoadGroup(
    ActivatedLoadGroupName=cluster_113.data_6,
    AdditionalSteps=replace_paths_15,
    prevData_itemkey=[0, 0, 0, 0, 0, 0, 0, 0, 0, 0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],
    prevData_key=[0, 1, 2, 3, 4, 5, 6, 7, 8, 9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])
c_s_deact_load_group_4 = CSDeactLoadGroup(
    DeactivatedLoadGroupName=cluster_111.data_5,
    prevData_itemkey=[0, 0, 0, 0, 0, 0, 0, 0, 0, 0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],
    prevData_key=[0, 1, 2, 3, 4, 5, 6, 7, 8, 9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])
c_s_act_load_group_4 = CSActLoadGroup(
    ActivatedLoadGroupName=cluster_111.data_6,
    prevData_itemkey=[0, 0, 0, 0, 0, 0, 0, 0, 0, 0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],
    prevData_key=[0, 1, 2, 3, 4, 5, 6, 7, 8, 9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])
c_s_act_load_group_5 = CSActLoadGroup(ActivatedLoadGroupName=cluster_112.data_6, prevData_itemkey=[0, 0], prevData_key=[0, 1])
c_s_act_load_group_6 = CSActLoadGroup(
    ActivatedLoadGroupName=cluster_114.data_6,
    prevData_itemkey=[0, 0, 0, 0, 0, 0, 0, 0, 0, 0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],
    prevData_key=[0, 1, 2, 3, 4, 5, 6, 7, 8, 9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])
c_s_act_load_group_7 = CSActLoadGroup(
    ActivatedLoadGroupName=cluster_118.data_6,
    AdditionalSteps=replace_paths_16,
    prevData_itemkey=[0, 0, 0, 0, 0, 0, 0, 0, 0, 0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],
    prevData_key=[0, 1, 2, 3, 4, 5, 6, 7, 8, 9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])
c_s_act_load_group_8 = CSActLoadGroup(
    ActivatedLoadGroupName=cluster_115.data_6,
    prevData_itemkey=[0, 0, 0, 0, 0, 0, 0, 0, 0, 0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],
    prevData_key=[0, 1, 2, 3, 4, 5, 6, 7, 8, 9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])
c_s_act_load_group_9 = CSActLoadGroup(ActivatedLoadGroupName=cluster_116.data_6, prevData_itemkey=0, prevData_key=0)
c_s_act_load_group_10 = CSActLoadGroup(ActivatedLoadGroupName=cluster_117.data_6, prevData_itemkey=0, prevData_key=0)
merge_51 = Merge(
    Data1=c_s_act_load_group_3,
    Data2=c_s_act_load_group_7,
    Data3=c_s_act_load_group_2,
    Data4=c_s_act_load_group_4,
    Data5=c_s_act_load_group_5,
    Data6=c_s_act_load_group_8,
    Data7=c_s_act_load_group_6,
    Data8=c_s_act_load_group_9,
    Data9=c_s_act_load_group_10,
    Data10=c_s_act_load_group)
merge_52 = Merge(Data1=c_s_deact_load_group, Data2=c_s_deact_load_group_3, Data3=c_s_deact_load_group_2, Data4=c_s_deact_load_group_4)

data_94 = Data(merge_49)
data_95 = Data(merge_51)
data_96 = Data(merge_52)
cluster_119 = Cluster_6(d1=data_94, list=graft_tree_20)
cluster_120 = Cluster_6(d1=data_95, list=graft_tree_20)
cluster_121 = Cluster_6(d1=data_96, list=graft_tree_20)
define_c_s = DefineCS(
    CSStageID=series_17,
    CSStageName=graft_tree_20,
    CSStageDuration=cluster_105,
    AdditionalStep=cluster_104,
    ActivationStructureGroup=cluster_106,
    ActivationBoundaryGroup=cluster_119,
    ActivationLoadGroup=cluster_120,
    DeactivationLoadGroup=cluster_121,
    prevData_itemkey=[1, 2, 3, 4, 5, 18, 17, 16, 15, 14, 13, 12, 11, 10, 9, 8, 7, 6, 26, 25, 24, 23, 22, 21, 20, 19, 27],
    prevData_key=[0, 1, 2, 3, 4, 17, 16, 15, 14, 13, 12, 11, 10, 9, 8, 7, 6, 5, 25, 24, 23, 22, 21, 20, 19, 18, 26])

midas_merge_data_5 = MidasMergeData(
    DATA1=structure_group_3,
    DATA2=structure_group,
    DATA3=structure_group_2,
    DATA4=structure_group_4,
    DATA5=structure_group_5,
    DATA6=structure_group_6,
    DATA7=load_group,
    DATA8=load_group_2,
    DATA9=load_group_3,
    DATA10=load_group_4,
    DATA12=load_group_5,
    DATA13=boundary_group,
    DATA14=boundary_group_2,
    DATA15=define_c_s)  # -> GRUP, LDGR, BNGR, STAG
midas_model_builder_5 = MidasModelBuilder(
    DATA1=midas_merge_data_5.GRUP,
    DATA2=midas_merge_data_5.LDGR,
    DATA3=midas_merge_data_5.BNGR,
    DATA4=midas_merge_data_5.STAG)

# ==== cluster Cluster
data = ClusterInput()
data_2 = Data(data)
list_length = ListLength(List=data_2)
shift_list = ShiftList(List=data_2, Shift=1, Wrap=False)
cull_index = CullIndex(List=data_2, Indices=expr("x-1", list_length), Wrap=True)
list = ClusterOutput(shift_list)
list_2 = ClusterOutput(cull_index)

# ==== cluster Cluster_2
tree = ClusterInput()
tree_statistics = TreeStatistics(Tree=tree)  # -> Paths, Length, Count
split_list = SplitList(List=tree_statistics.Paths, Index=Slider(2, range=0..10))  # -> ListA, ListB
data = ClusterInput()
split_tree = SplitTree(Data=data, Masks=flatten(split_list.ListA))  # -> Positive, Negative
replace_paths = ReplacePaths(Data=split_tree.Negative, Search=split_list.ListB, Replace=split_list.ListA)
list_length = ListLength(List=split_tree.Positive)  # -> flatten(Length)
list_length_2 = ListLength(List=replace_paths)  # -> flatten(Length)
sort_list = SortList(Keys=list_length)  # -> Keys, ValuesValuesA
sort_list_2 = SortList(Keys=list_length_2)  # -> Keys, ValuesValuesA
list_item = ListItem(List=sort_list.Keys, Index=-1, Wrap=True)
list_item_2 = ListItem(List=sort_list_2.Keys, Index=-1, Wrap=True)
series = Series(Start=1, Step=1, Count=list_item)
series_2 = Series(Start=1, Step=1, Count=list_item_2)
flip_matrix = FlipMatrix(Data=split_tree.Positive)
flip_matrix_2 = FlipMatrix(Data=replace_paths)
clean_tree = CleanTree(RemoveNulls=True, RemoveInvalid=True, RemoveEmpty=False, Tree=flip_matrix)
clean_tree_2 = CleanTree(RemoveNulls=True, RemoveInvalid=True, RemoveEmpty=False, Tree=flip_matrix_2)
tree_2 = ClusterOutput(clean_tree)
tree_3 = ClusterOutput(clean_tree_2)

# ==== cluster Cluster_3
member = ClusterInput()
data = ClusterInput()
data_2 = Data(data)
data_3 = ClusterInput()
data_4 = Data(data_3)
member_index = MemberIndex(Set=data_4, Member=member)  # -> Index, Count
tree_statistics = TreeStatistics(Tree=data_2)  # -> Paths, Length, Count
count = ClusterInput()
tree_statistics_2 = TreeStatistics(Tree=graft(data_4))  # -> Paths, Length, Count
series = Series(Start=member_index.Index, Step=1, Count=count)  # -> flatten(Series)
list_item = ListItem(List=tree_statistics_2.Paths, Index=series, Wrap=True)
replace_paths = ReplacePaths(Data=data_2, Search=tree_statistics.Paths, Replace=list_item)
data_5 = ClusterOutput(replace_paths)

# ==== cluster Cluster_4
tree = ClusterInput()
graft_tree = GraftTree(Tree=tree, IncludeEmptyLists=True, IncludeNullItems=True)
member_index = MemberIndex(Set=graft_tree, Member=Slider(0, range=0..100))  # -> Index, Count
cull_index = CullIndex(List=graft_tree, Indices=member_index.Index, Wrap=True)
shift_paths = ShiftPaths(Data=cull_index, Offset=-2)
data = ClusterOutput(shift_paths)

# ==== cluster Cluster_5
member = ClusterInput()
data = ClusterInput()
data_2 = Data(data)
data_3 = ClusterInput()
data_4 = Data(data_3)
member_index = MemberIndex(Set=data_4, Member=member)  # -> Index, Count
tree_statistics = TreeStatistics(Tree=data_2)  # -> Paths, Length, Count
count = ClusterInput()
B = ClusterInput()
series = Series(Start=member_index.Index, Step=1, Count=count)  # -> flatten(Series)
addition = Addition(A=series, B=B)
tree_statistics_2 = TreeStatistics(Tree=graft(data_4))  # -> Paths, Length, Count
list_item = ListItem(List=tree_statistics_2.Paths, Index=series, Wrap=True)
list_item_2 = ListItem(List=tree_statistics_2.Paths, Index=addition, Wrap=True)
panel = Panel(member)
replace_paths = ReplacePaths(Data=data_2, Search=tree_statistics.Paths, Replace=list_item_2)
replace_paths_2 = ReplacePaths(Data=data_2, Search=tree_statistics.Paths, Replace=list_item)
data_5 = ClusterOutput(replace_paths)
data_6 = ClusterOutput(replace_paths_2)

# ==== cluster Cluster_6
list = ClusterInput()
cull_index = CullIndex(List=list, Indices=Slider(0, range=0..100), Wrap=True)
d1 = ClusterInput()
shift_paths = ShiftPaths(Data=cull_index, Offset=-1)
merge = Merge(Data1=d1, Data2=shift_paths)
result = ClusterOutput(merge)

# ==== cluster Cluster_7
num = ClusterInput()
num_2 = ClusterInput()
num_3 = ClusterInput()
num_4 = Number(num)
num_5 = Number(num_2)
num_6 = Number(num_3)
addition = Addition(A=num_4, B=num_5, C=num_6)
F = ClusterInput()
X = ClusterInput()
Y = ClusterInput()
pt = ConstructPoint(XCoordinate=expr("-x", addition), YCoordinate=0, ZCoordinate=0)
pt_2 = ConstructPoint(XCoordinate=0, YCoordinate=0, ZCoordinate=0)
Y_2 = UnitY(Factor=F)
X_2 = ClusterInput()
Y_3 = ClusterInput()
pt_3 = ConstructPoint(XCoordinate=X, YCoordinate=Y, ZCoordinate=0)
Y_4 = ClusterInput()
move = Move(Geometry=pt, Motion=expr("-x", Y_2))  # -> Geometry, Transform
pt_4 = ConstructPoint(XCoordinate=X_2, YCoordinate=Y_3, ZCoordinate=0)
X_3 = ClusterInput()
Y_5 = ClusterInput()
addition_2 = Addition(A=move.Geometry, B=pt_3)
pt_5 = ConstructPoint(XCoordinate=num_4, YCoordinate=expr("-x", Y_4), ZCoordinate=0)
Y_6 = ClusterInput()
addition_3 = Addition(A=addition_2, B=pt_4)
pt_6 = ConstructPoint(XCoordinate=expr("-x", X_3), YCoordinate=Y_5, ZCoordinate=0)
pt_7 = ConstructPoint(XCoordinate=num_5, YCoordinate=expr("-x", Y_6), ZCoordinate=0)
addition_4 = Addition(A=move.Geometry, B=pt_5)
addition_5 = Addition(A=addition_4, B=pt_7)
addition_6 = Addition(A=addition_5, B=pt_6)
pt_8 = ConstructPoint(XCoordinate=num_6, YCoordinate=0, ZCoordinate=0)
addition_7 = Addition(A=addition_5, B=pt_8)
merge = Merge(
    Data1=pt_2,
    Data2=pt,
    Data3=move.Geometry,
    Data4=addition_2,
    Data5=addition_3,
    Data6=addition_4,
    Data7=addition_6,
    Data8=addition_5,
    Data9=addition_7)
merge_2 = Merge(Data1=pt_2, Data2=pt, Data3=move.Geometry, Data4=addition_2, Data5=addition_3, Data6=addition_4)
insert_items = InsertItems(List=addition_6, Item=merge_2, Indices=Slider(0, range=0..100), Wrap=True)  # -> simplify(List)
merge_3 = Merge(Data1=insert_items, Data2=addition_5, Data3=addition_7)
mirror = Mirror(Geometry=merge_3, Plane=PlaneYZ(0, 0, 0))  # -> Geometry, Transform
rev = ReverseList(List=mirror.Geometry)
merge_4 = Merge(Data1=merge_3, Data2=rev)
R = ClusterOutput(merge_4)

# ==== cluster BI11
num = ClusterInput()
num_2 = ClusterInput()
num_3 = ClusterInput()
num_4 = ClusterInput()
num_5 = ClusterInput()
X = ClusterInput()
Y = ClusterInput()
pt = ConstructPoint(XCoordinate=0, YCoordinate=0, ZCoordinate=0)
X_2 = ClusterInput()
Y_2 = ClusterInput()
num_6 = Number(num)
pt_2 = ConstructPoint(XCoordinate=0, YCoordinate=expr("-x", num_6), ZCoordinate=0)
num_7 = Number(num_2)
num_8 = Number(num_3)
num_9 = Number(num_4)
num_10 = Number(num_5)
pt_3 = ConstructPoint(XCoordinate=expr("-x", X), YCoordinate=expr("-x", Y), ZCoordinate=0)
X_3 = ClusterInput()
pt_4 = ConstructPoint(XCoordinate=expr("-x", X_2), YCoordinate=expr("-x", Y_2), ZCoordinate=0)
addition = Addition(A=num_6, B=num_7, C=num_8)
X_4 = ClusterInput()
Y_3 = ClusterInput()
X_5 = ClusterInput()
pt_5 = ConstructPoint(XCoordinate=expr("-x", X_3), YCoordinate=expr("-x", num_7), ZCoordinate=0)
addition_2 = Addition(A=pt_2, B=pt_3)
X_6 = ClusterInput()
addition_3 = Addition(A=addition_2, B=pt_4)
pt_6 = ConstructPoint(XCoordinate=X_4, YCoordinate=expr("-x", Y_3), ZCoordinate=0)
pt_7 = ConstructPoint(XCoordinate=0, YCoordinate=expr("-x", num_10), ZCoordinate=0)
pt_8 = ConstructPoint(XCoordinate=expr("-x", X_5), YCoordinate=expr("-x", addition), ZCoordinate=0)
X_7 = ClusterInput()
Y_4 = ClusterInput()
pt_9 = ConstructPoint(XCoordinate=X_6, YCoordinate=expr("-x", num_9), ZCoordinate=0)
addition_4 = Addition(A=pt_2, B=pt_5)
X_8 = ClusterInput()
Y_5 = ClusterInput()
pt_10 = ConstructPoint(XCoordinate=expr("-x", X_7), YCoordinate=Y_4, ZCoordinate=0)
addition_5 = Addition(A=addition_4, B=pt_6)
pt_11 = ConstructPoint(XCoordinate=expr("-x", X_8), YCoordinate=Y_5, ZCoordinate=0)
addition_6 = Addition(A=pt_8, B=pt_9)
addition_7 = Addition(A=addition_6, B=pt_7)
addition_8 = Addition(A=addition_6, B=pt_10)
addition_9 = Addition(A=addition_8, B=pt_11)
merge = Merge(
    Data2=pt_2,
    Data3=addition_2,
    Data4=addition_3,
    Data5=addition_4,
    Data6=addition_5,
    Data7=pt_8,
    Data8=addition_9,
    Data9=addition_8,
    Data10=addition_6)
merge_2 = Merge(Data1=pt_2, Data2=addition_2, Data3=addition_3, Data4=addition_4, Data5=addition_5)
insert_items = InsertItems(List=pt_8, Item=merge_2, Indices=Slider(0, range=0..100), Wrap=True)  # -> simplify(List)
merge_3 = Merge(Data1=insert_items, Data2=addition_9, Data3=addition_8, Data4=addition_6)
mirror = Mirror(Geometry=merge_3, Plane=PlaneYZ(0, 0, 0))  # -> Geometry, Transform
rev = ReverseList(List=mirror.Geometry)
merge_4 = Merge(Data1=merge_3, Data2=rev)
R = ClusterOutput(merge_4)

# ==== cluster Cluster_8
G = ClusterInput()
xy = XYPlane(Origin=Point(0, 0, 0))
rotate = Rotate(Geometry=G, Angle=-1.570796327, Plane=xy)  # -> Geometry, Transform
xz = XZPlane(Origin=Point(0, 0, 0))
rad = Radians(Degrees=Slider(90, range=0..360))
rotate_2 = Rotate(Geometry=rotate.Geometry, Angle=rad, Plane=xz)  # -> Geometry, Transform
P = ClusterOutput(xz)
T = ClusterInput()
move = Move(Geometry=rotate_2.Geometry, Motion=T)  # -> Geometry, Transform
G_2 = ClusterOutput(move.Geometry)

# ==== cluster Cluster_9
curve = ClusterInput()
parameter = ClusterInput()
evaluate_curve = EvaluateCurve(Curve=curve, Parameter=parameter)  # -> Point, Tangent, Angle
deconstruct_vector = DeconstructVector(Vector=evaluate_curve.Tangent)  # -> XComponent, YComponent, ZComponent
xy_plane = XYPlane(Origin=evaluate_curve.Point)
angle = Angle(VectorA="{1,0,0}", VectorB=evaluate_curve.Tangent)  # -> Angle, Reflex
plane = ClusterOutput(xy_plane)
ghpython_script = GhPythonScript(x=deconstruct_vector.YComponent, y=angle.Angle)  # -> out, a
# ---------- ghpython_script: Python ----------
__author__ = "kjw0601"
__version__ = "2024.11.21"

import rhinoscriptsyntax as rs

if x<0:
    a = -y
else:
    a = y
# ---------- end ghpython_script ----------
a = ClusterOutput(ghpython_script.a)

# ==== cluster Cluster_10
curve = ClusterInput()
end_points = EndPoints(Curve=curve)  # -> Start, End
deconstruct = Deconstruct(Point=end_points.Start)  # -> XComponent, YComponent, ZComponent
A = ClusterInput()
subtraction = Subtraction(A=A, B=deconstruct.XComponent)
result = ClusterOutput(subtraction)
construct_point = ConstructPoint(XCoordinate=subtraction, YCoordinate=0, ZCoordinate=0)
cull_duplicates = CullDuplicates(Points=construct_point, Tolerance=0.1, CullMode=3)  # -> Points, Indices, Valence
sort_points = SortPoints(Points=cull_duplicates.Points)  # -> flatten(Points), Indices
deconstruct_2 = Deconstruct(Point=sort_points.Points)  # -> graft(XComponent), YComponent, ZComponent
x_component = ClusterOutput(deconstruct_2.XComponent)

# ==== cluster Cluster_11
curve = ClusterInput()
curve_2 = Curve(curve)
length = Length(Curve=curve_2)
A = ClusterInput()
division = Division(A=A, B=length)
evaluate_curve = EvaluateCurve(Curve=reparameterize(curve_2), Parameter=division)  # -> Point, Tangent, Angle
point = ClusterOutput(evaluate_curve.Point)

# ==== cluster Cluster_12
tree = ClusterInput()
tree_statistics = TreeStatistics(Tree=tree)  # -> Paths, Length, Count
deconstruct_path = DeconstructPath(Branch=tree_statistics.Paths)
paths = ClusterOutput(tree_statistics.Paths)
list_item = ListItem(List=deconstruct_path, Index=1, Wrap=True)
list_item_2 = ListItem(List=deconstruct_path, Index=0, Wrap=True)
fragment_a = ClusterInput()
fragment_b = ClusterInput()
concatenate = Concatenate(Fragment_A=fragment_a, Fragment_B=fragment_b, A=list_item_2, B=list_item)
tree_statistics_2 = TreeStatistics(Tree=concatenate)  # -> Paths, Length, Count
replace_paths = ReplacePaths(Data=concatenate, Search=tree_statistics_2.Paths, Replace=tree_statistics.Paths)
data = ClusterOutput(replace_paths)

# ==== cluster Cluster_13
tree = ClusterInput()
tree_statistics = TreeStatistics(Tree=tree)  # -> Paths, Length, Count
start = ClusterInput()
series = Series(Start=expr("x+1", start), Step=1, Count=tree_statistics.Count)  # -> graft(Series)
tree_statistics_2 = TreeStatistics(Tree=series)  # -> Paths, Length, Count
replace_paths = ReplacePaths(Data=series, Search=tree_statistics_2.Paths, Replace=tree_statistics.Paths)
data = ClusterOutput(replace_paths)

# ==== cluster Cluster_14
number = ClusterInput()
number_2 = Number(number)
tree_statistics = TreeStatistics(Tree=number_2)  # -> Paths, Length, Count
list_item = ListItem(List=tree_statistics.Paths, Index=-1, Wrap=True)
split_tree = SplitTree(Data=number_2, Masks=flatten(list_item))  # -> Positive, Negative
positive = ClusterOutput(split_tree.Positive)

# ==== cluster Cluster_16
tree = ClusterInput()
tree_2 = ClusterInput()
tree_3 = ClusterInput()
flatten_tree = FlattenTree(Tree=tree, Path="{0}")
flatten_tree_2 = FlattenTree(Tree=tree_2, Path="{0}")
flatten_tree_3 = FlattenTree(Tree=tree_3, Path="{0}")
construct_point = ConstructPoint(XCoordinate=flatten_tree_3, YCoordinate=0, ZCoordinate=0)
deconstruct = Deconstruct(Point=flatten_tree)  # -> XComponent, YComponent, ZComponent
sort_points = SortPoints(Points=flatten_tree)  # -> Points, Indices
digit_scroller = DigitScroller(Scroller_Digits=12, Scroller_Prefix="Digit Scroller", Scroller_Radix=4, Scroller_Value=1e-06)
deconstruct_2 = Deconstruct(Point=sort_points.Points)  # -> XComponent, YComponent, ZComponent
sort_points_2 = SortPoints(Points=construct_point)  # -> Points, Indices
cull_duplicates = CullDuplicates(Points=sort_points_2.Points, Tolerance=digit_scroller, CullMode=3)  # -> Points, Indices, Valence
construct_point_2 = ConstructPoint(XCoordinate=deconstruct_2.XComponent, YCoordinate=0, ZCoordinate=0)
cull_duplicates_2 = CullDuplicates(Points=construct_point_2, Tolerance=digit_scroller, CullMode=3)  # -> Points, Indices, Valence
deconstruct_3 = Deconstruct(Point=cull_duplicates.Points)  # -> XComponent, YComponent, ZComponent
curve = ClusterInput()
deconstruct_4 = Deconstruct(Point=cull_duplicates_2.Points)  # -> XComponent, YComponent, ZComponent
cluster = Cluster_15(curve=curve, length=deconstruct_3.XComponent)  # -> graft(a), graft(plane)
param_viewer = ParamViewer(deconstruct_3.XComponent)
member_index = MemberIndex(Set=deconstruct.XComponent, Member=deconstruct_4.XComponent)  # -> Index, Count
list_item = ListItem(List=flatten_tree_2, Index=member_index.Index, Wrap=True)
rotate = Rotate(Geometry=list_item, Angle=cluster.a, Plane=cluster.plane)  # -> flatten(Geometry), Transform
text = Text(member_index.Index)
list_length = ListLength(List=flatten(text))
flatten_tree_4 = FlattenTree(Tree=text, Path="{0}")
series = Series(Start=0, Step=1, Count=list_length)  # -> flatten(Series)
text_2 = Text(flatten_tree_4)
text_3 = Text(series)
member_index_2 = MemberIndex(Set=text_2, Member=text_3)  # -> flatten(Index), Count
list_item_2 = ListItem(List=rotate.Geometry, Index=member_index_2.Index, Wrap=True)
i = ClusterOutput(list_item_2)

# ==== cluster Cluster_17
list = ClusterInput()
list_length = ListLength(List=list)  # -> flatten(Length)
sort_list = SortList(Keys=list_length)  # -> Keys, ValuesValuesA
list_item = ListItem(List=sort_list.Keys, Index=-1, Wrap=True)
series = Series(Start=1, Step=1, Count=list_item)
series_2 = ClusterOutput(series)

# ==== cluster Cluster_18
points = ClusterInput()
curve = ClusterInput()
curve_2 = Curve(curve)

cull_duplicates = CullDuplicates(Points=points, Tolerance=0.1, CullMode=3)  # -> Points, Indices, Valence
sort_points = SortPoints(Points=cull_duplicates.Points)  # -> Points, Indices
list_item = ListItem(List=sort_points.Points, Index=0, Wrap=True)  # -> flatten(Item)
graft_tree = GraftTree(Tree=sort_points.Points, IncludeEmptyLists=True, IncludeNullItems=True)
distance = Distance(PointA=list_item, PointB=graft_tree)
cull_index = CullIndex(List=flatten(distance), Indices=Slider(0, range=0..100), Wrap=True)
divide_distance = DivideDistance(Curve=curve_2, Distance=graft(cull_index))  # -> Points, Tangents, Parameters
list_item_2 = ListItem(List=divide_distance.Parameters, Index=Slider(1, range=0..1), Wrap=True)  # -> flatten(Item)
merge = Merge(Data1=Slider(0, range=0..100), Data2=list_item_2)
cull_index_2 = CullIndex(List=merge, Indices=expr("-1", -1), Wrap=True)
shift_list = ShiftList(List=merge, Shift=1, Wrap=False)
construct_domain = ConstructDomain(DomainStart=cull_index_2, DomainEnd=shift_list)
sub_curve = SubCurve(BaseCurve=curve_2, Domain=construct_domain)
length = Length(Curve=sub_curve)
mass_addition = MassAddition(Input=length)  # -> Result, PartialResults

partial_results = ClusterOutput(mass_addition.PartialResults)

# ==== cluster Cluster_19
number = ClusterInput()
number_2 = Number(flatten(number))
A = ClusterInput()
list_item = ListItem(List=number_2, Index=-1, Wrap=True)
division = Division(A=A, B=list_item)
result = ClusterOutput(division)
multiplication = Multiplication(A=number_2, B=division)  # -> flatten(Result)
curve = ClusterInput()
curve_2 = Curve(curve)
merge = Merge(Data1=Slider(0, range=0..100), Data2=number_2)
evaluate_length = EvaluateLength(Curve=curve_2, Length=merge, Normalized=False)  # -> Point, Tangent, Parameter
perp_frame = PerpFrame(Curve=reparameterize(curve_2), Parameter=evaluate_length.Parameter)  # -> graft(Frame)
curve_3 = ClusterInput()
curve_plane = CurvePlane(Curve=curve_3, Plane=perp_frame)  # -> Points, ParamsC, ParamsP
clean_tree = CleanTree(RemoveNulls=True, RemoveInvalid=True, RemoveEmpty=True, Tree=curve_plane.Points)
tree = ClusterOutput(clean_tree)

# ==== cluster Cluster_20
text = ClusterInput()
text_2 = ClusterInput()
text_3 = Text(text)
text_4 = Text(text_2)
member_index = MemberIndex(Set=text_4, Member=text_3)  # -> Index, Count
list = ClusterInput()
list_item = ListItem(List=list, Index=member_index.Index, Wrap=True)
explode = Explode(Curve=list_item, Recursive=True)  # -> Segments, Vertices
i = ClusterOutput(list_item)
vertices = ClusterOutput(explode.Vertices)

# ==== cluster Cluster_21
curve = ClusterInput()
d2 = ClusterInput()
end_points = EndPoints(Curve=curve)  # -> graft(Start), graft(End)
merge = Merge(Data1=end_points.Start, Data2=d2, Data3=end_points.End)
cull_duplicates = CullDuplicates(Points=merge, Tolerance=Slider(1e-05, range=0..1e-05), CullMode=3)  # -> Points, Indices, Valence
list_item = ListItem(List=cull_duplicates.Points, Index=0, Wrap=True)
tree_statistics = TreeStatistics(Tree=cull_duplicates.Points)  # -> Paths, Length, Count
deconstruct = Deconstruct(Point=list_item)  # -> XComponent, YComponent, ZComponent
A = ClusterInput()
subtraction = Subtraction(A=A, B=deconstruct.XComponent)  # -> flatten(Result)
text = ClusterInput()
text_2 = Text(text)
text_3 = Text(subtraction)
member_index = MemberIndex(Set=text_3, Member=text_2)  # -> Index, Count
list_item_2 = ListItem(List=tree_statistics.Paths, Index=member_index.Index, Wrap=True)
split_tree = SplitTree(Data=cull_duplicates.Points, Masks=flatten(list_item_2))  # -> Positive, Negative
positive = ClusterOutput(split_tree.Positive)

# ==== cluster Cluster_22
data = ClusterInput()
B = ClusterInput()
point = ClusterInput()
data_2 = Data(data)
point_2 = Point(point)
division = Division(A=data_2, B=B)
geometry = ClusterInput()
geometry_2 = ClusterInput()
scale = Scale(Geometry=geometry, Center=point_2, Factor=division)  # -> Geometry, Transform
scale_2 = Scale(Geometry=geometry_2, Center=point_2, Factor=division)  # -> Geometry, Transform
geometry_3 = ClusterOutput(scale.Geometry)
geometry_4 = ClusterOutput(scale_2.Geometry)

# ==== cluster Cluster_23
curve = ClusterInput()
end_points = EndPoints(Curve=curve)  # -> Start, End
average = Average(Input=[end_points.Start, end_points.End])
curve_2 = ClusterInput()
length = ClusterInput()
evaluate_length = EvaluateLength(Curve=curve_2, Length=length, Normalized=False)  # -> Point, Tangent, Parameter
deconstruct = Deconstruct(Point=average)  # -> XComponent, YComponent, ZComponent
construct_point = ConstructPoint(XCoordinate=deconstruct.XComponent, YCoordinate=deconstruct.YComponent, ZCoordinate=0)
geometry = ClusterInput()
vector_2pt = Vector2Pt(PointA=construct_point, PointB=evaluate_length.Point, Unitize=False)  # -> Vector, Length
move = Move(Geometry=geometry, Motion=vector_2pt.Vector)  # -> Geometry, Transform
geometry_2 = ClusterOutput(move.Geometry)

# ==== cluster Cluster_15
curve = ClusterInput()
length = ClusterInput()
evaluate_length = EvaluateLength(Curve=curve, Length=length, Normalized=False)  # -> Point, Tangent, Parameter
deconstruct_vector = DeconstructVector(Vector=evaluate_length.Point)  # -> XComponent, YComponent, ZComponent
xy_plane = XYPlane(Origin=evaluate_length.Point)
angle = Angle(VectorA="{1,0,0}", VectorB=evaluate_length.Tangent)  # -> Angle, Reflex
plane = ClusterOutput(xy_plane)
ghpython_script = GhPythonScript(x=deconstruct_vector.YComponent, y=angle.Angle)  # -> out, a; same code as ghpython_script
a = ClusterOutput(ghpython_script.a)
